# Grasshopper definition cylindrical_coords.gh (Grasshopper 1.0.7)

# ----
# Cylindrical Coords.
number_slider = Slider(2.3, range=0..10)  # disabled
number_slider_2 = Slider(22.427, range=0..50)  # disabled
r1 = Slider(20.207, range=0..50)  # disabled
theta1 = Slider(0.724, range=0..6.283)  # disabled
z1 = Slider(9.241, range=-100..100)  # disabled
box_domain = BooleanToggle(True)  # disabled
projection = BooleanToggle(True)  # disabled
r_slice = BooleanToggle(False)  # disabled
just_box = BooleanToggle(False)  # disabled
z_slice = BooleanToggle(True)  # disabled
number_slider_3 = Slider(5, range=0..30)  # disabled
division = Division(A=number_slider, B=number_slider_2)  # disabled
z2 = Slider(22.923, range=0..100)  # disabled
r2 = Slider(4.712, range=0..50)  # disabled
theta2 = Slider(2.856, range=0..6.283)  # disabled
number_slider_4 = Slider(4, range=0..7)  # disabled
number_slider_5 = Slider(2, range=0..7)  # disabled
number_slider_6 = Slider(2, range=0..7)  # disabled
dom = ConstructDomain(DomainStart=r1, DomainEnd=r2)  # disabled
dom_2 = ConstructDomain(DomainStart=theta1, DomainEnd=theta2)  # disabled
dom_3 = ConstructDomain(DomainStart=z1, DomainEnd=z2)  # disabled
addition = Addition(A=theta1, B=division)  # disabled
addition_2 = Addition(A=r1, B=number_slider)  # disabled
addition_3 = Addition(A=z1, B=number_slider)  # disabled
range = Range(Domain=dom_2, Steps=number_slider_3)  # disabled
range_2 = Range(Domain=dom, Steps=number_slider_3)  # disabled
range_3 = Range(Domain=dom_3, Steps=number_slider_3)  # disabled
number_slider_7 = Slider(87, range=0..255)  # disabled
number_slider_8 = Slider(38, range=0..255)  # disabled
number_slider_9 = Slider(240, range=0..255)  # disabled
number_slider_10 = Slider(138, range=0..255)  # disabled
cluster = Cluster(num_2=theta1, num=addition, num_4=r1, num_5=addition_2, num_3=z1, num_6=addition_3)  # disabled
cluster_2 = Cluster(num_2=theta1, num=theta2, num_4=r1, num_5=r2, num_3=0)  # disabled
shift = ShiftList(List=range_3, Shift=-1, Wrap=False)  # disabled
shift_2 = ShiftList(List=range, Shift=-1, Wrap=False)  # disabled
shift_3 = ShiftList(List=range_2, Shift=-1, Wrap=False)  # disabled
shift_4 = ShiftList(List=range_3, Shift=1, Wrap=False)  # disabled
shift_5 = ShiftList(List=range, Shift=1, Wrap=False)  # disabled
shift_6 = ShiftList(List=range_2, Shift=1, Wrap=False)  # disabled
rgb = ColourRGB(Alpha=number_slider_10, Red=number_slider_9, Green=number_slider_7, Blue=number_slider_8)  # disabled
item = ListItem(List=shift_5, Index=number_slider_5, Wrap=True)  # disabled
item_2 = ListItem(List=shift_2, Index=number_slider_5, Wrap=True)  # disabled
item_3 = ListItem(List=shift_4, Index=number_slider_4, Wrap=True)  # disabled
item_4 = ListItem(List=shift, Index=number_slider_4, Wrap=True)  # disabled
item_5 = ListItem(List=shift_6, Index=number_slider_6, Wrap=True)  # disabled
item_6 = ListItem(List=shift_3, Index=number_slider_6, Wrap=True)  # disabled
preview = CustomPreview(Geometry=cluster, Material=rgb)  # disabled
filter = StreamFilter(Gate=just_box, Stream0=shift_4, Stream1=item_3)  # disabled
filter_2 = StreamFilter(Gate=just_box, Stream0=shift_3, Stream1=item_6)  # disabled
filter_3 = StreamFilter(Gate=just_box, Stream0=shift, Stream1=item_4)  # disabled
filter_4 = StreamFilter(Gate=just_box, Stream0=shift_6, Stream1=item_5)  # disabled
cluster_3 = Cluster_3(num_2=theta1, num=theta2, num_4=range_2, num_3=z1, num_5=z2)  # -> E, C; disabled
cluster_4 = Cluster_4(num_2=theta1, num=theta2, num_4=r1, num_5=r2, num_3=range_3)  # disabled
cluster_5 = Cluster_2(num=range, num_3=r1, num_4=r2, num_2=z1, num_5=z2)  # -> E, C; disabled
cluster_6 = Cluster(num_2=item, num=item_2, num_4=item_5, num_5=item_6, num_3=filter, num_6=filter_3)  # disabled
cluster_7 = Cluster(num_2=item, num=item_2, num_4=filter_4, num_5=filter_2, num_3=item_3, num_6=item_4)  # disabled
cluster_8 = Cluster(num_2=item, num=item_2, num_4=item_5, num_5=item_6, num_3=0)  # disabled
cluster_9 = Cluster(num_2=item, num=item_2, num_4=filter_4, num_5=filter_2, num_3=0)  # disabled
number_slider_11 = Slider(50, range=0..255)  # disabled
number_slider_12 = Slider(255, range=0..255)  # disabled
number_slider_13 = Slider(0, range=0..255)  # disabled
number_slider_14 = Slider(148, range=0..255)  # disabled
item_7 = ListItem(List=cluster_3.E, Index=0, Wrap=True)  # disabled
item_8 = ListItem(List=cluster_3.E, Index=-1, Wrap=True)  # disabled
item_9 = ListItem(List=cluster_5.E, Index=-1, Wrap=True)  # disabled
item_10 = ListItem(List=cluster_4, Index=0, Wrap=True)  # disabled
item_11 = ListItem(List=cluster_4, Index=-1, Wrap=True)  # disabled
item_12 = ListItem(List=cluster_5.E, Index=0, Wrap=True)  # disabled
debrep = DeconstructBrep(Brep=[cluster_5.E, cluster_3.E, cluster_4])  # -> Faces, Edges, Vertices; disabled
number_slider_15 = Slider(50, range=0..255)  # disabled
rgb_2 = ColourRGB(Alpha=number_slider_13, Red=number_slider_14, Green=number_slider_11, Blue=number_slider_12)  # disabled
number_slider_16 = Slider(255, range=0..255)  # disabled
number_slider_17 = Slider(47, range=0..255)  # disabled
number_slider_18 = Slider(148, range=0..255)  # disabled
number_slider_19 = Slider(50, range=0..255)  # disabled
number_slider_20 = Slider(255, range=0..255)  # disabled
number_slider_21 = Slider(148, range=0..255)  # disabled
number_slider_22 = Slider(47, range=0..255)  # disabled
number_slider_23 = Slider(87, range=0..255)  # disabled
number_slider_24 = Slider(87, range=0..255)  # disabled
number_slider_25 = Slider(38, range=0..255)  # disabled
number_slider_26 = Slider(240, range=0..255)  # disabled
number_slider_27 = Slider(25, range=0..255)  # disabled
number_slider_28 = Slider(201, range=0..255)  # disabled
number_slider_29 = Slider(138, range=0..255)  # disabled
number_slider_30 = Slider(248, range=0..255)  # disabled
rgb_3 = ColourRGB(Alpha=number_slider_17, Red=number_slider_18, Green=number_slider_15, Blue=number_slider_16)  # disabled
dispatch = Dispatch(List=cluster_8, DispatchPattern=projection)  # -> ListA, ListB; disabled
dispatch_2 = Dispatch(List=cluster_9, DispatchPattern=projection)  # -> ListA, ListB; disabled
dispatch_3 = Dispatch(List=cluster_6, DispatchPattern=box_domain)  # -> ListA, ListB; disabled
dispatch_4 = Dispatch(List=cluster_7, DispatchPattern=box_domain)  # -> ListA, ListB; disabled
dispatch_5 = Dispatch(List=debrep.Edges, DispatchPattern=box_domain)  # -> ListA, ListB; disabled
rgb_4 = ColourRGB(Alpha=number_slider_22, Red=number_slider_21, Green=number_slider_19, Blue=number_slider_20)  # disabled
rgb_5 = ColourRGB(Alpha=number_slider_29, Red=number_slider_26, Green=number_slider_23, Blue=number_slider_25)  # disabled
rgb_6 = ColourRGB(Alpha=number_slider_30, Red=number_slider_28, Green=number_slider_24, Blue=number_slider_27)  # disabled
dispatch_6 = Dispatch(List=[cluster_2, cluster_5.C, cluster_3.C], DispatchPattern=projection)  # -> ListA, ListB; disabled
dispatch_7 = Dispatch(List=dispatch_2.ListA, DispatchPattern=r_slice)  # -> ListA, ListB; disabled
dispatch_8 = Dispatch(List=dispatch_4.ListA, DispatchPattern=r_slice)  # -> ListA, ListB; disabled
dispatch_9 = Dispatch(List=dispatch.ListA, DispatchPattern=z_slice)  # -> ListA, ListB; disabled
dispatch_10 = Dispatch(List=dispatch_3.ListA, DispatchPattern=z_slice)  # -> ListA, ListB; disabled
preview_2 = CustomPreview(Geometry=dispatch_6.ListA, Material=rgb_3)  # disabled
preview_3 = CustomPreview(Geometry=dispatch_7.ListA, Material=rgb_6)  # disabled
preview_4 = CustomPreview(Geometry=dispatch_8.ListA, Material=rgb_6)  # disabled
preview_5 = CustomPreview(Geometry=dispatch_10.ListA, Material=rgb_5)  # disabled
preview_6 = CustomPreview(Geometry=[item_12, item_9, item_7, item_8, item_10, item_11], Material=rgb_4)  # disabled
preview_7 = CustomPreview(Geometry=dispatch_5.ListA, Material=rgb_2)  # disabled
preview_8 = CustomPreview(Geometry=dispatch_9.ListA, Material=rgb_5)  # disabled

number_slider_31 = Slider(14.567, range=0..100)  # disabled
number_slider_32 = Slider(8.917, range=0..100)  # disabled
number_slider_33 = Slider(34.25, range=0..100)  # disabled
number_slider_34 = Slider(34.25, range=0..100)  # disabled
neg = Negative(Value=number_slider_33)  # disabled
dom_4 = ConstructDomain(DomainStart=neg, DomainEnd=number_slider_33)  # disabled
neg_2 = Negative(Value=number_slider_33)  # disabled
multiplication = Multiplication(A=number_slider_33, B=2)  # disabled
xy = XYPlane(Origin=Point(0, 0, 0))  # disabled
pt = ConstructPoint(XCoordinate=0, YCoordinate=number_slider_32, ZCoordinate=neg_2)  # disabled
xy_2 = XYPlane(Origin=Point(0, 0, 0))  # disabled
pt_2 = ConstructPoint(XCoordinate=0, YCoordinate=number_slider_31, ZCoordinate=neg_2)  # disabled
pl_origin = PlaneOrigin(Base=xy, Origin=pt)  # disabled
pl_origin_2 = PlaneOrigin(Base=xy_2, Origin=pt_2)  # disabled
sph = Sphere(Base=PlaneXY(0, 0, 0), Radius=number_slider_33)  # disabled
number_slider_35 = Slider(87, range=0..255)  # disabled
number_slider_36 = Slider(212, range=0..255)  # disabled
number_slider_37 = Slider(22, range=0..255)  # disabled
number_slider_38 = Slider(97, range=0..255)  # disabled
cyl = Cylinder(Base=pl_origin, Radius=number_slider_32, Length=multiplication)  # disabled
cyl_2 = Cylinder(Base=pl_origin_2, Radius=number_slider_31, Length=multiplication)  # disabled
number_slider_39 = Slider(87, range=0..255)  # disabled
number_slider_40 = Slider(212, range=0..255)  # disabled
number_slider_41 = Slider(192, range=0..255)  # disabled
number_slider_42 = Slider(97, range=0..255)  # disabled
rgb_7 = ColourRGB(Alpha=number_slider_38, Red=number_slider_37, Green=number_slider_35, Blue=number_slider_36)  # disabled
sint = SolidIntersection(BrepsA=sph, BrepsB=cyl_2)  # disabled
number_slider_43 = Slider(0.087, range=0..1)  # disabled
rgb_8 = ColourRGB(Alpha=number_slider_42, Red=number_slider_41, Green=number_slider_39, Blue=number_slider_40)  # disabled
planesrf = PlaneSurface(Plane=PlaneXY(0, 0, 0), XSize=dom_4, YSize=dom_4)  # disabled
Z = UnitZ(Factor=number_slider_43)  # disabled
extr = Extrude(Base=planesrf, Direction=Z)  # disabled
sint_2 = SolidIntersection(BrepsA=extr, BrepsB=cyl_2)  # disabled
sdiff = SolidDifference(BrepsA=sint, BrepsB=cyl)  # disabled
preview_9 = CustomPreview(Geometry=sdiff, Material=rgb_8)  # disabled
sdiff_2 = SolidDifference(BrepsA=sint_2, BrepsB=cyl)  # disabled
preview_10 = CustomPreview(Geometry=sdiff_2, Material=rgb_7)  # disabled
number_slider_44 = Slider(85.258, range=0..100)  # disabled
number_slider_45 = Slider(11, range=0..30)  # disabled
dom_5 = ConstructDomain(DomainStart=0, DomainEnd=number_slider_44)  # disabled
range_4 = Range(Domain=dom_5, Steps=number_slider_45)  # disabled
cone2 = BooleanToggle(False)
sphere_2 = BooleanToggle(False)
half_plane_1 = BooleanToggle(False)
number_slider_46 = Slider(0.116, range=0..1)  # disabled
cir = Circle(Plane=PlaneXY(0, 0, 0), Radius=range_4)  # disabled
pipe = Pipe(Curve=cir, Radius=number_slider_46, Caps=0)  # disabled
md_slider = MDSlider(
    SliderMode=0,
    slider_value=Point(0.113586037, 0.4756097561, 0.5),
    x_domain=Domain(0, 6.283185307),
    y_domain=Domain(0, 75),
    z_domain=Domain(0, 1))  # disabled
mesh = MeshBrep(
    Brep=pipe,
    Settings={GridMaxCount=0, GridMinCount=16, JaggedSeams=False, MaxEdgeLength=0, MinEdgeLength=0.0001, MinTolerance=0, Refine=True, RefineAngle=0, RelativeTolerance=0.65, SimplePlanes=True, Tolerance=0})  # disabled
number_slider_47 = Slider(50, range=0..255)  # disabled
number_slider_48 = Slider(54, range=0..255)  # disabled
number_slider_49 = Slider(49, range=0..255)  # disabled
number_slider_50 = Slider(27, range=0..255)  # disabled
pdecon = Deconstruct(Point=md_slider)  # -> XComponent, YComponent, ZComponent; disabled
rgb_9 = ColourRGB(Alpha=number_slider_50, Red=number_slider_49, Green=number_slider_47, Blue=number_slider_48)  # disabled
preview_11 = CustomPreview(Geometry=mesh, Material=rgb_9)  # disabled
rgb_10 = ColourRGB(
    Alpha=Slider(255, range=0..255),
    Red=Slider(60, range=0..255),
    Green=Slider(54, range=0..255),
    Blue=Slider(67, range=0..255))

# ----
# Spherical Coords.
half_plane_1_2 = BooleanToggle(False)
cone1 = BooleanToggle(False)
sub_box = BooleanToggle(False)
sphere_1 = BooleanToggle(False)
box = BooleanToggle(True)
delta_phi = Slider(0.221, range=0..0.5)
phi_1 = Slider(1.947, range=0..3.141)
theta_1 = Slider(2.97, range=0..6.283)
rho_1 = Slider(46.222, range=0..100)
delta_rho = Slider(12.186, range=0..20)
delta_theta = Slider(0.296, range=0..0.5)
phi_2 = Slider(2.618, range=0..3.141)
phi_1_2 = Slider(0.524, range=0..3.141)
rho_1_2 = Slider(0, range=0..100)
rho_2 = Slider(59.925, range=0..100)
theta_2 = Slider(1.567, range=0..6.283)
theta_1_2 = Slider(0, range=0..6.283)
addition_4 = Addition(A=theta_1, B=delta_theta)
addition_5 = Addition(A=phi_1, B=delta_phi)
addition_6 = Addition(A=rho_1, B=delta_rho)
sph_2 = Sphere(Base=PlaneXY(0, 0, 0), Radius=rho_1_2)
addition_7 = Addition(A=phi_1_2, B=-0.001)
addition_8 = Addition(A=phi_2, B=0.01)
dom_6 = ConstructDomain(DomainStart=theta_1_2, DomainEnd=theta_2)
num = Number(rho_2)
dom_7 = ConstructDomain(DomainStart=theta_1, DomainEnd=addition_4)
neg_3 = Negative(Value=rho_2)
num_2 = Number(addition_6)
cone = Cone(rho=rho_2, phi=phi_1_2)
cone_2 = Cone(rho=rho_2, phi=phi_2)
neg_4 = Negative(Value=addition_6)
number_slider_51 = Slider(186, range=0..255)
number_slider_52 = Slider(57, range=0..255)
number_slider_53 = Slider(50, range=0..255)
cone_3 = Cone(rho=addition_6, phi=phi_1)
cone_4 = Cone(rho=addition_6, phi=addition_5)
sph_3 = Sphere(Base=PlaneXY(0, 0, 0), Radius=rho_1)
xz = XZPlane(Origin=Point(0, 0, 0))
dom_8 = ConstructDomain(DomainStart=neg_3, DomainEnd=rho_2)
dom_9 = ConstructDomain(DomainStart=0, DomainEnd=rho_2)
arc = Arc(Plane=PlaneXY(0, 0, 0), Radius=num, Angle=dom_6)  # -> Arc, Length
xz_2 = XZPlane(Origin=Point(0, 0, 0))
dom_10 = ConstructDomain(DomainStart=neg_4, DomainEnd=addition_6)
dom_11 = ConstructDomain(DomainStart=0, DomainEnd=addition_6)
arc_2 = Arc(Plane=PlaneXY(0, 0, 0), Radius=num_2, Angle=dom_7)  # -> Arc, Length
Z_2 = UnitZ(Factor=num)
xz_3 = XZPlane(Origin=Point(0, 0, 0))
Z_3 = UnitZ(Factor=num_2)
planesrf_2 = PlaneSurface(Plane=xz, XSize=dom_9, YSize=dom_8)
rgb_11 = ColourRGB(Alpha=Slider(203, range=0..255), Red=number_slider_53, Green=number_slider_51, Blue=number_slider_52)
xz_4 = XZPlane(Origin=Point(0, 0, 0))
cone_5 = Cone(rho=rho_2, phi=addition_8)
cone_6 = Cone(rho=rho_2, phi=addition_7)
planesrf_3 = PlaneSurface(Plane=xz_2, XSize=dom_11, YSize=dom_10)
multiplication_2 = Multiplication(A=Z_2, B=2)
neg_5 = Negative(Value=Z_2)
prot = RotatePlane(Plane=xz_3, Angle=1.570796327)
dom_12 = ConstructDomain(DomainStart=phi_1_2, DomainEnd=phi_2)
multiplication_3 = Multiplication(A=Z_3, B=2)
neg_6 = Negative(Value=Z_3)
prot_2 = RotatePlane(Plane=xz_4, Angle=1.570796327)
dom_13 = ConstructDomain(DomainStart=phi_1, DomainEnd=addition_5)
dispatch_11 = Dispatch(List=sph_2, DispatchPattern=sphere_1)  # -> ListA, ListB
move = Move(Geometry=arc.Arc, Motion=neg_5)  # -> Geometry, Transform
addition_9 = Addition(A=theta_1_2, B=-0.001)
addition_10 = Addition(A=theta_2, B=0.01)
move_2 = Move(Geometry=arc_2.Arc, Motion=neg_6)  # -> Geometry, Transform
rotate = Rotate(Geometry=planesrf_2, Angle=theta_1_2, Plane=PlaneXY(0, 0, 0))  # -> Geometry, Transform
arc_3 = Arc(Plane=prot, Radius=rho_2, Angle=dom_12)  # -> Arc, Length
rotate_2 = Rotate(Geometry=planesrf_2, Angle=theta_2, Plane=PlaneXY(0, 0, 0))  # -> Geometry, Transform
rotate_3 = Rotate(Geometry=planesrf_3, Angle=theta_1, Plane=PlaneXY(0, 0, 0))  # -> Geometry, Transform
arc_4 = Arc(Plane=prot_2, Radius=addition_6, Angle=dom_13)  # -> Arc, Length
rotate_4 = Rotate(Geometry=planesrf_3, Angle=addition_4, Plane=PlaneXY(0, 0, 0))  # -> Geometry, Transform
dispatch_12 = Dispatch(List=cone_6, DispatchPattern=cone1)  # -> ListA, ListB
extr_2 = Extrude(Base=move.Geometry, Direction=multiplication_2)
rotate_5 = Rotate(Geometry=planesrf_2, Angle=addition_9, Plane=PlaneXY(0, 0, 0))  # -> Geometry, Transform
rotate_6 = Rotate(Geometry=planesrf_2, Angle=addition_10, Plane=PlaneXY(0, 0, 0))  # -> Geometry, Transform
revsrf = Revolution(Curve=arc_3.Arc, Axis=Line((0, 0, 0), (0, 0, 1)), Domain=Domain(0, 6.283185307))
extr_3 = Extrude(Base=move_2.Geometry, Direction=multiplication_3)
rgb_12 = ColourRGB(
    Alpha=Slider(203, range=0..255),
    Red=Slider(50, range=0..255),
    Green=Slider(87, range=0..255),
    Blue=Slider(212, range=0..255))
revsrf_2 = Revolution(Curve=arc_4.Arc, Axis=Line((0, 0, 0), (0, 0, 1)), Domain=Domain(0, 6.283185307))
join = BrepJoin(Breps=[rotate.Geometry, rotate_2.Geometry, extr_2])  # -> Breps, Closed
preview_12 = CustomPreview(Geometry=dispatch_11.ListA, Material=rgb_11)
join_2 = BrepJoin(Breps=[rotate_3.Geometry, rotate_4.Geometry, extr_3])  # -> Breps, Closed
join_3 = BrepJoin(Breps=flatten([cone_4, cone_3, revsrf_2]))  # -> Breps, Closed
rgb_13 = ColourRGB(
    Alpha=Slider(203, range=0..255),
    Red=Slider(255, range=0..255),
    Green=Slider(186, range=0..255),
    Blue=Slider(57, range=0..255))
cap = CapHoles(Brep=join.Breps)
cap_2 = CapHoles(Brep=join_2.Breps)
sdiff_3 = SolidDifference(BrepsA=join_3.Breps, BrepsB=sph_3)
dispatch_13 = Dispatch(List=rotate_5.Geometry, DispatchPattern=half_plane_1_2)  # -> ListA, ListB
sint_3 = SolidIntersection(BrepsA=sdiff_3, BrepsB=cap_2)
dispatch_14 = Dispatch(List=sint_3, DispatchPattern=sub_box)  # -> ListA, ListB
rgb_14 = ColourRGB(
    Alpha=Slider(108, range=0..255),
    Red=Slider(120, range=0..255),
    Green=Slider(118, range=0..255),
    Blue=Slider(123, range=0..255))
rgb_15 = ColourRGB(
    Alpha=Slider(233, range=0..255),
    Red=Slider(244, range=0..255),
    Green=Slider(111, range=0..255),
    Blue=Slider(75, range=0..255))
preview_13 = CustomPreview(Geometry=dispatch_14.ListA, Material=rgb_15)

python = GhPythonScript(rho=pdecon.YComponent, theta=pdecon.XComponent, phi=phi_1_2)  # -> out, x, y, z; disabled
# ---------- python: Python ----------
__author__ = "will"
__version__ = "2020.10.17"

import rhinoscriptsyntax as rs

from math import sin, cos

x=rho*sin(phi)*cos(theta)
y=rho*sin(phi)*sin(theta)
z=rho*cos(phi)
# ---------- end python ----------
pt_3 = ConstructPoint(XCoordinate=python.x, YCoordinate=python.y, ZCoordinate=python.z)  # disabled
addition_11 = Addition(A=rho_2, B=0.1)
sph_4 = Sphere(Base=PlaneXY(0, 0, 0), Radius=addition_11)
dispatch_15 = Dispatch(List=sph_4, DispatchPattern=sphere_2)  # -> ListA, ListB
dispatch_16 = Dispatch(List=cone_5, DispatchPattern=cone2)  # -> ListA, ListB
rgb_16 = ColourRGB(Alpha=Slider(128, range=0..255), Red=number_slider_53, Green=number_slider_51, Blue=number_slider_52)
dispatch_17 = Dispatch(List=[cone, cone_2], DispatchPattern=box)  # -> ListA, ListB
preview_14 = CustomPreview(Geometry=dispatch_15.ListA, Material=rgb_16)
dispatch_18 = Dispatch(List=rotate_6.Geometry, DispatchPattern=half_plane_1)  # -> ListA, ListB

preview_15 = CustomPreview(Geometry=[dispatch_12.ListA, dispatch_16.ListA], Material=rgb_12)
join_4 = BrepJoin(Breps=flatten([dispatch_17.ListA, revsrf]))  # -> Breps, Closed
sdiff_4 = SolidDifference(BrepsA=join_4.Breps, BrepsB=sph_2)
sint_4 = SolidIntersection(BrepsA=sdiff_4, BrepsB=cap)
preview_16 = CustomPreview(Geometry=[dispatch_13.ListA, dispatch_18.ListA], Material=rgb_13)
dispatch_19 = Dispatch(List=sint_4, DispatchPattern=box)  # -> ListA, ListB
preview_17 = CustomPreview(Geometry=dispatch_19.ListA, Material=rgb_14)

debrep_2 = DeconstructBrep(Brep=dispatch_19.ListA)  # -> Faces, Edges, Vertices
pipe_2 = Pipe(Curve=debrep_2.Edges, Radius=Slider(0.091, range=0..1), Caps=0)
preview_18 = CustomPreview(Geometry=pipe_2, Material=rgb_10)

# ==== cluster Cone
rho = ClusterInput()
phi = ClusterInput()
python = GhPythonScript(rho=rho, phi=phi)  # -> out, R, L
# ---------- python: Python ----------
__author__ = "will"
__version__ = "2020.10.15"

import rhinoscriptsyntax as rs

from math import sin, cos

R = rho*sin(phi)

L = rho*cos(phi)
# ---------- end python ----------
xy = XYPlane(Origin=Point(0, 0, 0))
Z = UnitZ(Factor=python.L)
neg = Negative(Value=python.L)
move = Move(Geometry=xy, Motion=Z)  # -> Geometry, Transform
cone = Cone(Base=move.Geometry, Radius=python.R, Length=neg)  # -> Cone, Tip
C = ClusterOutput(cone.Cone)

# ==== cluster Cluster
num = ClusterInput()
num_2 = ClusterInput()
num_3 = ClusterInput()
num_4 = ClusterInput()
num_5 = ClusterInput()
num_6 = ClusterInput()
num_7 = Number(num)
num_8 = Number(num_2)
num_9 = Number(num_3)
num_10 = Number(num_4)
num_11 = Number(num_5)
num_12 = Number(num_6)
dom = ConstructDomain(DomainStart=num_8, DomainEnd=num_7)
python = GhPythonScript(r=num_10, theta=num_7)  # -> out, x, y
# ---------- python: Python ----------
__author__ = "will"

import rhinoscriptsyntax as rs

from math import sin, cos

x = r*cos(theta)
y = r*sin(theta)
# ---------- end python ----------
python_2 = GhPythonScript(r=1, theta=num_8)  # -> out, x, y; same code as python
python_3 = GhPythonScript(r=1, theta=num_7)  # -> out, x, y; same code as python
python_4 = GhPythonScript(r=num_10, theta=num_8)  # -> out, x, y; same code as python
pt = ConstructPoint(XCoordinate=0, YCoordinate=0, ZCoordinate=num_9)
xy = XYPlane(Origin=Point(0, 0, 0))
vec = VectorXYZ(XComponent=python_2.x, YComponent=python_2.y, ZComponent=0)  # -> Vector, Length
vec_2 = VectorXYZ(XComponent=python_3.x, YComponent=python_3.y, ZComponent=0)  # -> Vector, Length
pt_2 = ConstructPoint(XCoordinate=python.x, YCoordinate=python.y, ZCoordinate=num_9)
pt_3 = ConstructPoint(XCoordinate=python_4.x, YCoordinate=python_4.y, ZCoordinate=num_9)
pl_origin = PlaneOrigin(Base=xy, Origin=pt)
subtraction = Subtraction(A=num_11, B=num_10)
subtraction_2 = Subtraction(A=num_12, B=num_9)
arc = Arc(Plane=pl_origin, Radius=num_11, Angle=dom)  # -> Arc, Length
arc_2 = Arc(Plane=pl_origin, Radius=num_10, Angle=dom)  # -> Arc, Length
line = LineSDL(Start=pt_2, Direction=vec_2.Vector, Length=subtraction)
line_2 = LineSDL(Start=pt_3, Direction=vec.Vector, Length=subtraction)
join = JoinCurves(Curves=[arc_2.Arc, line_2, arc.Arc, line], Preserve=False)
Z = UnitZ(Factor=subtraction_2)
boundary = BoundarySurfaces(Edges=join)
extr = Extrude(Base=boundary, Direction=Z)
E = ClusterOutput(extr)

# ==== cluster Cluster_2
num = ClusterInput()
num_2 = ClusterInput()
num_3 = ClusterInput()
num_4 = ClusterInput()
num_5 = ClusterInput()
num_6 = Number(num)
num_7 = Number(num_2)
num_8 = Number(num_3)
num_9 = Number(num_4)
num_10 = Number(num_5)
python = GhPythonScript(r=1, theta=num_6)  # -> out, x, y; same code as python
python_2 = GhPythonScript(r=num_8, theta=num_6)  # -> out, x, y; same code as python
python_3 = GhPythonScript(r=num_8, theta=num_6)  # -> out, x, y; same code as python
vec = VectorXYZ(XComponent=python.x, YComponent=python.y, ZComponent=0)  # -> Vector, Length
pt = ConstructPoint(XCoordinate=python_2.x, YCoordinate=python_2.y, ZCoordinate=num_7)
pt_2 = ConstructPoint(XCoordinate=python_3.x, YCoordinate=python_3.y, ZCoordinate=0)
subtraction = Subtraction(A=num_9, B=num_8)
subtraction_2 = Subtraction(A=num_10, B=num_7)
line = LineSDL(Start=pt, Direction=vec.Vector, Length=subtraction)
line_2 = LineSDL(Start=pt_2, Direction=vec.Vector, Length=subtraction)
join = JoinCurves(Curves=line, Preserve=False)
Z = UnitZ(Factor=subtraction_2)
join_2 = JoinCurves(Curves=line_2, Preserve=False)
C = ClusterOutput(join_2)
extr = Extrude(Base=join, Direction=Z)
E = ClusterOutput(extr)

# ==== cluster Cluster_3
num = ClusterInput()
num_2 = ClusterInput()
num_3 = ClusterInput()
num_4 = ClusterInput()
num_5 = ClusterInput()
num_6 = Number(num)
num_7 = Number(num_2)
num_8 = Number(num_3)
num_9 = Number(num_4)
num_10 = Number(num_5)
dom = ConstructDomain(DomainStart=num_7, DomainEnd=num_6)
pt = ConstructPoint(XCoordinate=0, YCoordinate=0, ZCoordinate=num_8)
xy = XYPlane(Origin=Point(0, 0, 0))
subtraction = Subtraction(A=num_10, B=num_8)
pl_origin = PlaneOrigin(Base=xy, Origin=pt)
arc = Arc(Plane=PlaneXY(0, 0, 0), Radius=num_9, Angle=dom)  # -> Arc, Length
arc_2 = Arc(Plane=pl_origin, Radius=num_9, Angle=dom)  # -> Arc, Length
join = JoinCurves(Curves=arc.Arc, Preserve=False)
join_2 = JoinCurves(Curves=arc_2.Arc, Preserve=False)
Z = UnitZ(Factor=subtraction)
C = ClusterOutput(join)
extr = Extrude(Base=join_2, Direction=Z)
E = ClusterOutput(extr)

# ==== cluster Cluster_4
num = ClusterInput()
num_2 = ClusterInput()
num_3 = ClusterInput()
num_4 = ClusterInput()
num_5 = ClusterInput()
num_6 = Number(num)
num_7 = Number(num_2)
num_8 = Number(num_3)
num_9 = Number(num_4)
num_10 = Number(num_5)
dom = ConstructDomain(DomainStart=num_7, DomainEnd=num_6)
python = GhPythonScript(r=num_9, theta=num_6)  # -> out, x, y; same code as python
python_2 = GhPythonScript(r=1, theta=num_7)  # -> out, x, y; same code as python
python_3 = GhPythonScript(r=1, theta=num_6)  # -> out, x, y; same code as python
python_4 = GhPythonScript(r=num_9, theta=num_7)  # -> out, x, y; same code as python
pt = ConstructPoint(XCoordinate=0, YCoordinate=0, ZCoordinate=num_8)
xy = XYPlane(Origin=Point(0, 0, 0))
vec = VectorXYZ(XComponent=python_2.x, YComponent=python_2.y, ZComponent=0)  # -> Vector, Length
vec_2 = VectorXYZ(XComponent=python_3.x, YComponent=python_3.y, ZComponent=0)  # -> Vector, Length
pt_2 = ConstructPoint(XCoordinate=python.x, YCoordinate=python.y, ZCoordinate=num_8)
pt_3 = ConstructPoint(XCoordinate=python_4.x, YCoordinate=python_4.y, ZCoordinate=num_8)
pl_origin = PlaneOrigin(Base=xy, Origin=pt)
subtraction = Subtraction(A=num_10, B=num_9)
arc = Arc(Plane=pl_origin, Radius=num_10, Angle=dom)  # -> Arc, Length
arc_2 = Arc(Plane=pl_origin, Radius=num_9, Angle=dom)  # -> Arc, Length
line = LineSDL(Start=pt_2, Direction=vec_2.Vector, Length=subtraction)
line_2 = LineSDL(Start=pt_3, Direction=vec.Vector, Length=subtraction)
join = JoinCurves(Curves=[arc_2.Arc, line_2, arc.Arc, line], Preserve=False)
boundary = BoundarySurfaces(Edges=join)
S = ClusterOutput(boundary)
