# Grasshopper definition gravity_vfield.gh (Grasshopper 1.0.7)

md_slider = MDSlider(
    SliderMode=0,
    slider_value=Point(0.5240260334, 0.5647769091, 0.5),
    x_domain=Domain(-50, 50),
    y_domain=Domain(-50, 50),
    z_domain=Domain(0, 1))
pt = ConstructPoint(XCoordinate=0, YCoordinate=0, ZCoordinate=Slider(0.486, range=-50..50))
number_slider = Slider(-40, range=-50..-25)
move = Move(Geometry=md_slider, Motion=pt)  # -> Geometry, Transform
pl_origin = PlaneOrigin(Base=PlaneXY(0, 0, 0), Origin=move.Geometry)
number_slider_2 = Slider(6.3, range=0..20)
addition = Addition(A=50, B=number_slider)
sph = Sphere(Base=pl_origin, Radius=number_slider_2)
pt_2 = ConstructPoint(XCoordinate=number_slider, YCoordinate=number_slider, ZCoordinate=0)
dom = ConstructDomain(DomainStart=-50, DomainEnd=50)
integer_division = IntegerDivision(A=100, B=addition)
volume = Volume(Geometry=sph)  # -> Volume, Centroid
range = Range(Domain=dom, Steps=integer_division)  # -> graft(Range)
pt_3 = Point(volume.Centroid)
rec_2pt = Rectangle2Pt(Plane=PlaneXY(0, 0, 0), PointA=Point(-50, -50, 0), PointB=pt_2, Radius=0)  # -> Rectangle, Length
python = GhPythonScript(radius=number_slider_2)  # -> out, mass
# ---------- python: Python ----------
__author__ = "will"
__version__ = "2020.07.02"

import rhinoscriptsyntax as rs
from math import pi


radius = radius*1000000
volume = 4*pi*(radius**3)/3
mass = volume*5510
# ---------- end python ----------
pt_4 = ConstructPoint(XCoordinate=-50, YCoordinate=-50, ZCoordinate=range)
arrrec = RectangularArray(Geometry=pt_4, Cell=rec_2pt.Rectangle, XCount=integer_division, YCount=integer_division)  # -> Geometry, Transform
dist = Distance(PointA=arrrec.Geometry, PointB=pt_3)  # -> flatten(Distance)
vec2pt = Vector2Pt(PointA=arrrec.Geometry, PointB=pt_3, Unitize=True)  # -> flatten(Vector), Length
python_2 = GhPythonScript(distance=dist, mass=python.mass)  # -> out, F
# ---------- python_2: Python ----------
__author__ = "will"
__version__ = "2020.07.02"

import rhinoscriptsyntax as rs


#moon_radius = 350000
#moon_density = 3340
#moon_vol = 4*pi*(moon_radius**3)/3
#moon_mass = moon_vol*moon_density




if distance>20:
    F = (.00000000006674*(mass*15))/((1000000*distance)**2)
else:
    F=0
# ---------- end python_2 ----------
multiplication = Multiplication(A=vec2pt.Vector, B=python_2.F)
vdis = VectorDisplay(Anchor=flatten(arrrec.Geometry), Vector=multiplication)  # disabled
mypreview = RGBPreview(A=255)
vdisex = VectorDisplayEx(Point=flatten(arrrec.Geometry), Vector=multiplication, Colour=RGB(209, 40, 40), Width=2)

# ==== cluster RGBPreview: Custom Preview clustered with RGB module with preset colors
N = ClusterInput()
python = GhPythonScript(N=N)  # -> out, R, G, B
# ---------- python: Python ----------
__author__ = "will"
__version__ = "2020.07.20"

import rhinoscriptsyntax as rs

colors=[(0,0,0),(255,255,255),(115,115,115),(255,0,0),(0,255,0),(0,0,255),(255,255,0),(255,0,255),(0,255,255),(0,162,255),(252,124,21),(124,51,202),(23,151,59),(255,80,90),(255,80,226),(32,214,255),(0,92,0),(0,0,120),(112,255,49),(138,78,0)]

N=int(N)
R = colors[N][0]
G = colors[N][1]
B = colors[N][2]
# ---------- end python ----------
A = ClusterInput()
G = ClusterInput()
rgb = ColourRGB(Alpha=A, Red=python.R, Green=python.G, Blue=python.B)
preview = CustomPreview(Geometry=G, Material=rgb)
