# Grasshopper definition helicoid.gh (Grasshopper 1.0.7)
# plug-ins: Pufferfish

crv = Curve(<curve referenced from the Rhino model>)
crv_2 = Curve(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)
rebcrv = RebuildCurve(Curve=crv_2, EndTangents=False)
rotate = Rotate(Geometry=rebcrv, Angle=3.141592654, Plane=PlaneXY(0, 0, 0))  # -> Geometry, Transform
md_slider = MDSlider(
    SliderMode=0,
    slider_value=Point(0.776422268, 0.6951226956, 0.5),
    x_domain=Domain(0, 1),
    y_domain=Domain(0, 1),
    z_domain=Domain(0, 1))
loft = Loft(
    Curves=[rotate.Geometry, rebcrv],
    Options={Adjust=False, Closed=False, LoftEnds=0, LoftSimp=0, LoftType=0, Rebuild=10, Refit=0.001})
swp2 = Sweep2(Rail1=rotate.Geometry, Rail2=rebcrv, Sections=crv, SameHeight=False)
mesh = MeshBrep(
    Brep=loft,
    Settings={GridMaxCount=0, GridMinCount=16, JaggedSeams=False, MaxEdgeLength=0, MinEdgeLength=0.0001, MinTolerance=0, Refine=True, RefineAngle=0, RelativeTolerance=0.65, SimplePlanes=True, Tolerance=0})
iso = IsoCurve(Surface=reparameterize(loft), UVPoint=md_slider)  # -> UIsocurve, VIsocurve
pipe = Pipe(Curve=iso.VIsocurve, Radius=Slider(0.097, range=0..1), Caps=2)
pipe_2 = Pipe(Curve=iso.UIsocurve, Radius=Slider(0.07, range=0..1), Caps=2)
mypreview = RGBPreview(G=mesh, A=Slider(148, range=0..255), N=Slider(8, range=0..19))
mypreview_2 = RGBPreview(G=pipe_2, A=Slider(255, range=0..255), N=Slider(13, range=0..19))
mypreview_3 = RGBPreview(G=pipe, A=Slider(255, range=0..255), N=Slider(18, range=0..19))

# ==== cluster RGBPreview: Custom Preview clustered with RGB module with preset colors
N = ClusterInput()
python = GhPythonScript(N=N)  # -> out, R, G, B
# ---------- python: Python ----------
__author__ = "will"
__version__ = "2020.07.20"

import rhinoscriptsyntax as rs

colors=[(0,0,0),(255,255,255),(115,115,115),(255,0,0),(0,255,0),(0,0,255),(255,255,0),(255,0,255),(0,255,255),(0,162,255),(252,124,21),(124,51,202),(23,151,59),(255,80,90),(255,80,226),(32,214,255),(0,92,0),(0,0,120),(112,255,49),(138,78,0)]

N=int(N)
R = colors[N][0]
G = colors[N][1]
B = colors[N][2]
# ---------- end python ----------
A = ClusterInput()
G = ClusterInput()
rgb = ColourRGB(Alpha=A, Red=python.R, Green=python.G, Blue=python.B)
preview = CustomPreview(Geometry=G, Material=rgb)
