# Grasshopper definition orientation.gh (Grasshopper 1.0.7)

md_slider = MDSlider(
    SliderMode=0,
    slider_value=Point(0.886248984, 0.7427771964, 0.5),
    x_domain=Domain(0, 1),
    y_domain=Domain(0, 1),
    z_domain=Domain(0, 1))
revolution = BooleanToggle(True)
negative = BooleanToggle(False)
field = BooleanToggle(True)
vec = BooleanToggle(True)
md_slider_2 = MDSlider(
    SliderMode=0,
    slider_value=Point(0.4381100724, 0.9277849895, 0.5),
    x_domain=Domain(0, 1),
    y_domain=Domain(0, 1),
    z_domain=Domain(0, 1))
mobius = BooleanToggle(False)
vec_2 = BooleanToggle(False)
field_2 = BooleanToggle(False)
dom = ConstructDomain(DomainStart=0, DomainEnd=6.283185307)
range = Range(Domain=dom, Steps=Slider(31, range=0..50))
python = GhPythonScript(t=range)  # -> out, x, y, z
# ---------- python: Python ----------
__author__ = "will"
__version__ = "2020.11.07"

import rhinoscriptsyntax as rs
from math import sin, cos, pi

x=cos(t)*(5-cos((t+pi)/2))
y=sin(t)*(5-sin((t+pi)/2))
z=-sin((t+pi)/2)
# ---------- end python ----------
python_2 = GhPythonScript(t=range)  # -> out, x, y, z
# ---------- python_2: Python ----------
__author__ = "will"
__version__ = "2020.11.07"

import rhinoscriptsyntax as rs
from math import sin, cos, pi

x=cos(t)*(5+cos((t+pi)/2))
y=sin(t)*(5+sin((t+pi)/2))
z=sin((t+pi)/2)
# ---------- end python_2 ----------
dom_2 = ConstructDomain(DomainStart=0, DomainEnd=1)
dom_3 = ConstructDomain(DomainStart=0, DomainEnd=1)
dom_4 = ConstructDomain(DomainStart=0, DomainEnd=1)
dom_5 = ConstructDomain(DomainStart=0, DomainEnd=1)
range_2 = Range(Domain=dom_2, Steps=Slider(19, range=0..30))
range_3 = Range(Domain=dom_3, Steps=Slider(26, range=0..40))
pt = ConstructPoint(XCoordinate=python.x, YCoordinate=python.y, ZCoordinate=python.z)
pt_2 = ConstructPoint(XCoordinate=python_2.x, YCoordinate=python_2.y, ZCoordinate=python_2.z)
dom_6 = ConstructDomain(DomainStart=0, DomainEnd=1)
dom_7 = ConstructDomain(DomainStart=0, DomainEnd=1)
range_4 = Range(Domain=dom_4, Steps=Slider(18, range=0..30))
range_5 = Range(Domain=dom_5, Steps=Slider(22, range=0..40))
pt_3 = ConstructPoint(XCoordinate=graft(range_2), YCoordinate=range_3, ZCoordinate=0)
range_6 = Range(Domain=dom_6, Steps=Slider(3, range=0..30))
range_7 = Range(Domain=dom_7, Steps=Slider(31, range=0..40))
intcrv = Interpolate(Vertices=pt_2, Degree=3, Periodic=False, KnotStyle=1)  # -> Curve, Length, Domain
dom_8 = ConstructDomain(DomainStart=0, DomainEnd=Slider(6.283, range=0..6.283))
crv = Curve(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)
intcrv_2 = Interpolate(Vertices=pt, Degree=3, Periodic=False, KnotStyle=1)  # -> Curve, Length, Domain
pt_4 = ConstructPoint(XCoordinate=range_4, YCoordinate=range_5, ZCoordinate=0)
dispatch = Dispatch(List=pt_3, DispatchPattern=field)  # -> ListA, ListB
dispatch_2 = Dispatch(List=md_slider, DispatchPattern=vec)  # -> ListA, ListB
revsrf = Revolution(Curve=crv, Axis=Line((0, 0, 0), (17, 0, 0)), Domain=dom_8)
pt_5 = ConstructPoint(XCoordinate=graft(range_6), YCoordinate=range_7, ZCoordinate=0)
loft = Loft(
    Curves=[intcrv_2.Curve, intcrv.Curve],
    Options={Adjust=False, Closed=False, LoftEnds=0, LoftSimp=0, LoftType=0, Rebuild=10, Refit=0.01})
scale = Scale(Geometry=loft, Center=Point(0, 0, 0), Factor=Slider(4.679, range=0..10))  # -> Geometry, Transform
evalsrf = EvaluateSurface(Surface=reparameterize(revsrf), Point=[dispatch_2.ListA, dispatch.ListA])  # -> Point, Normal, UDirection, VDirection, Frame
iso = IsoCurve(Surface=reparameterize(revsrf), UVPoint=pt_4)  # -> UIsocurve, VIsocurve
dispatch_3 = Dispatch(List=pt_5, DispatchPattern=field_2)  # -> ListA, ListB
dispatch_4 = Dispatch(List=md_slider_2, DispatchPattern=vec_2)  # -> ListA, ListB
vec_3 = Vector(evalsrf.Normal)
neg = Negative(Value=vec_3)
evalsrf_2 = EvaluateSurface(Surface=reparameterize(scale.Geometry), Point=[dispatch_4.ListA, dispatch_3.ListA])  # -> Point, Normal, UDirection, VDirection, Frame
pipe = Pipe(Curve=[iso.UIsocurve, iso.VIsocurve], Radius=Slider(0.093, range=0..0.2), Caps=2)
filter = StreamFilter(Gate=negative, Stream0=vec_3, Stream1=neg)
vec_4 = Vector(evalsrf_2.Normal)
cluster = Cluster(pt=evalsrf.Point, vec=filter, num=Slider(0.25, range=0..1))  # -> P, C
dispatch_5 = Dispatch(List=revsrf, DispatchPattern=revolution)  # -> ListA, ListB
cluster_2 = Cluster_2(pt=evalsrf_2.Point, vec=vec_4, num=Slider(0.177, range=0..1))  # -> P, C
dispatch_6 = Dispatch(List=pipe, DispatchPattern=revolution)  # -> ListA, ListB
geo = Geometry([cluster.P, cluster.C])
dispatch_7 = Dispatch(List=geo, DispatchPattern=revolution)  # -> ListA, ListB
geo_2 = Geometry([cluster_2.P, cluster_2.C])
dispatch_8 = Dispatch(List=scale.Geometry, DispatchPattern=mobius)  # -> ListA, ListB
mypreview = RGBPreview(G=dispatch_8.ListA, A=Slider(255, range=0..255), N=Slider(10, range=0..19))
mypreview_2 = RGBPreview(G=geo_2, A=Slider(232, range=0..255), N=Slider(11, range=0..19))
mypreview_3 = RGBPreview(G=dispatch_7.ListA, A=Slider(216, range=0..255), N=Slider(11, range=0..19))
mypreview_4 = RGBPreview(G=dispatch_5.ListA, A=Slider(216, range=0..255), N=Slider(10, range=0..19))
mypreview_5 = RGBPreview(G=dispatch_6.ListA, A=Slider(190, range=0..255), N=Slider(2, range=0..19))

# ==== cluster RGBPreview: Custom Preview clustered with RGB module with preset colors
N = ClusterInput()
python = GhPythonScript(N=N)  # -> out, R, G, B
# ---------- python: Python ----------
__author__ = "will"
__version__ = "2020.07.20"

import rhinoscriptsyntax as rs

colors=[(0,0,0),(255,255,255),(115,115,115),(255,0,0),(0,255,0),(0,0,255),(255,255,0),(255,0,255),(0,255,255),(0,162,255),(252,124,21),(124,51,202),(23,151,59),(255,80,90),(255,80,226),(32,214,255),(0,92,0),(0,0,120),(112,255,49),(138,78,0)]

N=int(N)
R = colors[N][0]
G = colors[N][1]
B = colors[N][2]
# ---------- end python ----------
A = ClusterInput()
G = ClusterInput()
rgb = ColourRGB(Alpha=A, Red=python.R, Green=python.G, Blue=python.B)
preview = CustomPreview(Geometry=G, Material=rgb)

# ==== cluster Cluster
pt = ClusterInput()
vec = ClusterInput()
num = ClusterInput()
num_2 = Number(num)
pt_2 = Point(pt)
vec_2 = Vector(vec)
vlen = VectorLength(Vector=vec_2)
multiplication = Multiplication(A=num_2, B=3)
multiplication_2 = Multiplication(A=vlen, B=Slider(10.996, range=0..20))
multiplication_3 = Multiplication(A=multiplication, B=3)
line = LineSDL(Start=pt_2, Direction=vec_2, Length=multiplication_2)
pipe = Pipe(Curve=line, Radius=num_2, Caps=0)
P = ClusterOutput(pipe)
eval = EvaluateLength(Curve=line, Length=multiplication_2, Normalized=False)  # -> Point, Tangent, Parameter
pl = PlaneNormal(Origin=eval.Point, ZAxis=vec_2)
cone = Cone(Base=pl, Radius=multiplication, Length=multiplication_3)  # -> Cone, Tip
C = ClusterOutput(cone.Cone)

# ==== cluster Cluster_2
num = ClusterInput()
pt = ClusterInput()
vec = ClusterInput()
num_2 = Number(num)
pt_2 = Point(pt)
vec_2 = Vector(vec)
vlen = VectorLength(Vector=vec_2)
multiplication = Multiplication(A=num_2, B=3)
multiplication_2 = Multiplication(A=vlen, B=Slider(10.996, range=0..20))
multiplication_3 = Multiplication(A=multiplication, B=3)
line = LineSDL(Start=pt_2, Direction=vec_2, Length=multiplication_2)
pipe = Pipe(Curve=line, Radius=num_2, Caps=0)
P = ClusterOutput(pipe)
eval = EvaluateLength(Curve=line, Length=multiplication_2, Normalized=False)  # -> Point, Tangent, Parameter
pl = PlaneNormal(Origin=eval.Point, ZAxis=vec_2)
cone = Cone(Base=pl, Radius=multiplication, Length=multiplication_3)  # -> Cone, Tip
C = ClusterOutput(cone.Cone)
