# Grasshopper definition parametric_surfaces.gh (Grasshopper 1.0.7)
# plug-ins: Pufferfish

number_slider = Slider(18, range=0..100)  # disabled
number_slider_2 = Slider(3, range=0..10)  # disabled
u_cyclic = BooleanToggle(False)  # disabled
v_cyclic = BooleanToggle(False)  # disabled
md_slider = MDSlider(
    SliderMode=0,
    slider_value=Point(0.365243307, 0.4353656304, 0.5),
    x_domain=Domain(-1, 1),
    y_domain=Domain(-1, 1),
    z_domain=Domain(0, 1))  # disabled
panel = Panel("""[-2,2]
[0,1]
[-2,2]
[0,pi-.0001]""")  # disabled
panel_2 = Panel("""[-2,2]
[0,1]
[-2,2]
[0,pi-.0001]""")  # disabled
number_slider_3 = Slider(1, range=1..1.2)  # disabled
item = ListItem(List=panel, Index=number_slider_2, Wrap=True)  # disabled
item_2 = ListItem(List=panel_2, Index=number_slider_2, Wrap=True)  # disabled
number_slider_4 = Slider(20, range=0..100)
number_slider_5 = Slider(4, range=0..10)
dom = ConstructDomain(DomainStart=0, DomainEnd=1)  # disabled
planesrf = PlaneSurface(Plane=PlaneXY(0, 0, 0), XSize=Domain(-10, 10), YSize=Domain(-10, 10))  # disabled
rectangle = Rectangle(Plane=PlaneXY(0, 0, 0), XSize=item, YSize=item_2, Radius=0)  # -> Rectangle, Length; disabled
rectangle_2 = Rectangle(Plane=PlaneXY(0, 0, 0), XSize=item, YSize=item_2, Radius=0)  # -> Rectangle, Length; disabled
range = Range(Domain=dom, Steps=Slider(25, range=0..100))  # disabled
range_2 = Range(Domain=dom, Steps=Slider(25, range=0..100))  # disabled
scale = Scale(Geometry=rectangle.Rectangle, Center=Point(0, 0, 0), Factor=number_slider_3)  # -> Geometry, Transform; disabled
panel_3 = Panel("""u-(u**3)/3+u*v**2
(2+sin(2*pi*v)*sin(2*pi*u))*sin(3*pi*v)
u
(cos(u)/(1-sqrt(2)*sin(u)*cos(u)*sin(3*v)))*((sqrt(2)/3)*cos(u)*cos(2*v)+(2/3)*sin(u)*cos(v))""")  # disabled
panel_4 = Panel("""v-(v**3)/3+v*u**2
sin(2*pi*v)*cos(2*pi*u)+4*v-2
v
(cos(u)/(1-sqrt(2)*sin(u)*cos(u)*sin(3*v)))*((sqrt(2)/3)*cos(u)*sin(2*v)-(2/3)*sin(u)*sin(v))""")  # disabled
panel_5 = Panel("""u**2-v**2
(2+sin(2*pi*v)*sin(2*pi*u))*cos(3*pi*v)
u**2-v**2
(cos(u)/(1-sqrt(2)*sin(u)*cos(u)*sin(3*v)))*cos(u)-1""")  # disabled
number_slider_6 = Slider(25, range=0..100)  # disabled
number_slider_7 = Slider(10, range=0..100)  # disabled
neg = Negative(Value=number_slider_4)
paramrecgrid = ParameterRectangleGrid(Rectangle=scale.Geometry, ParametersX=range, ParametersY=range_2)  # -> Cells, Points; disabled
panel_6 = Panel("""[-2,2]
[0,1]
[-1,1]
[0,pi-.0001]
[1,3]""")
panel_7 = Panel("""[-2,2]
[0,1]
[-1,1]
[0,pi-.0001]
[0,2*pi]""")
dom_2 = ConstructDomain(DomainStart=0, DomainEnd=1)  # disabled
dom_3 = ConstructDomain(DomainStart=number_slider_4, DomainEnd=neg)
item_3 = ListItem(List=panel_6, Index=number_slider_5, Wrap=True)
item_4 = ListItem(List=panel_7, Index=number_slider_5, Wrap=True)
item_5 = ListItem(List=panel_3, Index=number_slider_2, Wrap=True)  # disabled
item_6 = ListItem(List=panel_4, Index=number_slider_2, Wrap=True)  # disabled
item_7 = ListItem(List=panel_5, Index=number_slider_2, Wrap=True)  # disabled
pdecon = Deconstruct(Point=paramrecgrid.Points)  # -> XComponent, YComponent, ZComponent; disabled
dom_4 = ConstructDomain(DomainStart=0, DomainEnd=1)
number_slider_8 = Slider(20, range=0..50)  # disabled
range_3 = Range(Domain=dom_2, Steps=number_slider_6)  # disabled
range_4 = Range(Domain=dom_2, Steps=number_slider_7)  # disabled
rectangle_3 = Rectangle(Plane=PlaneXY(0, 0, 0), XSize=item_3, YSize=item_4, Radius=0)  # -> Rectangle, Length
rectangle_4 = Rectangle(Plane=PlaneXY(0, 0, 0), XSize=item_3, YSize=item_4, Radius=0)  # -> Rectangle, Length
planesrf_2 = PlaneSurface(Plane=PlaneXY(0, 0, 0), XSize=dom_3, YSize=Domain(-10, 10))
python = GhPythonScript(X=item_5, Y=item_6, Z=item_7, u=pdecon.XComponent, v=pdecon.YComponent)  # -> out, pt; disabled; same code as python
range_5 = Range(Domain=dom_4, Steps=Slider(20, range=0..100))
range_6 = Range(Domain=dom_4, Steps=number_slider_4)
scale_2 = Scale(Geometry=rectangle_3.Rectangle, Center=Point(0, 0, 0), Factor=Slider(1, range=1..1.2))  # -> Geometry, Transform
number_slider_9 = Slider(0.6, range=0..1)  # disabled
number_slider_10 = Slider(2, range=0..20)  # disabled
number_slider_11 = Slider(0.1, range=0..1)  # disabled
panel_8 = Panel("""v-(v**3)/3+v*u**2
sin(2*pi*v)*cos(2*pi*u)+4*v-2
v
(cos(u)/(1-sqrt(2)*sin(u)*cos(u)*sin(3*v)))*((sqrt(2)/3)*cos(u)*sin(2*v)-(2/3)*sin(u)*sin(v))
u*cos(v)""")
panel_9 = Panel("""u-(u**3)/3+u*v**2
(2+sin(2*pi*v)*sin(2*pi*u))*sin(3*pi*v)
u
(cos(u)/(1-sqrt(2)*sin(u)*cos(u)*sin(3*v)))*((sqrt(2)/3)*cos(u)*cos(2*v)+(2/3)*sin(u)*cos(v))
u*sin(v)""")
panel_10 = Panel("""u**2-v**2
(2+sin(2*pi*v)*sin(2*pi*u))*cos(3*pi*v)
u**2-v**2
(cos(u)/(1-sqrt(2)*sin(u)*cos(u)*sin(3*v)))*cos(u)-1
sqrt(u**2-1)""")
paramrecgrid_2 = ParameterRectangleGrid(Rectangle=rectangle_2.Rectangle, ParametersX=range_3, ParametersY=range_4)  # -> Cells, Points; disabled
scale_3 = Scale(Geometry=python.pt, Center=Point(0, 0, 0), Factor=number_slider_8)  # -> Geometry, Transform; disabled
paramrecgrid_3 = ParameterRectangleGrid(Rectangle=scale_2.Geometry, ParametersX=range_6, ParametersY=range_5)  # -> Cells, Points
paramrecgrid_4 = ParameterRectangleGrid(Rectangle=rectangle_4.Rectangle, ParametersX=range_6, ParametersY=range_5)  # -> Cells, Points
pt = Point(scale_3.Geometry)  # disabled
flip = FlipMatrix(Data=pt)  # disabled
item_8 = ListItem(List=panel_9, Index=number_slider_5, Wrap=True)
item_9 = ListItem(List=panel_8, Index=number_slider_5, Wrap=True)
item_10 = ListItem(List=panel_10, Index=number_slider_5, Wrap=True)
pdecon_2 = Deconstruct(Point=paramrecgrid_4.Points)  # -> XComponent, YComponent, ZComponent
intcrv = Interpolate(Vertices=flip, Degree=3, Periodic=False, KnotStyle=1)  # -> flatten(Curve), Length, Domain; disabled
intcrv_2 = Interpolate(Vertices=pt, Degree=3, Periodic=False, KnotStyle=1)  # -> flatten(Curve), Length, Domain; disabled
number_slider_12 = Slider(0, range=0..20)  # disabled
cluster = Cluster(
    F_2=number_slider_8,
    geo=paramrecgrid_2.Cells,
    X=item_5,
    Y=item_6,
    F=number_slider_9,
    Z=item_7,
    N_2=number_slider_10,
    N=number_slider_10)  # disabled
python_2 = GhPythonScript(X=item_8, Y=item_9, Z=item_10, u=pdecon_2.XComponent, v=pdecon_2.YComponent)  # -> out, pt; same code as python
u_cyclic_2 = BooleanToggle(False)
v_cyclic_2 = BooleanToggle(True)
split = SplitList(List=intcrv_2.Curve, Index=1)  # -> ListA, ListB; disabled
split_2 = SplitList(List=intcrv.Curve, Index=1)  # -> ListA, ListB; disabled
scale_4 = Scale(Geometry=python_2.pt, Center=Point(0, 0, 0), Factor=Slider(50, range=0..50))  # -> Geometry, Transform
item_11 = ListItem(List=intcrv.Curve, Index=number_slider_12, Wrap=True)  # disabled
pt_2 = Point(scale_4.Geometry)
filter = StreamFilter(Gate=u_cyclic, Stream0=intcrv_2.Curve, Stream1=split.ListB)  # disabled
geo = Geometry(cluster)  # disabled
filter_2 = StreamFilter(Gate=v_cyclic, Stream0=intcrv.Curve, Stream1=split_2.ListB)  # disabled
number_slider_13 = Slider(0.501, range=0..1)  # disabled
flip_2 = FlipMatrix(Data=pt_2)
intcrv_3 = Interpolate(Vertices=flip_2, Degree=3, Periodic=False, KnotStyle=1)  # -> flatten(Curve), Length, Domain
intcrv_4 = Interpolate(Vertices=pt_2, Degree=3, Periodic=False, KnotStyle=1)  # -> flatten(Curve), Length, Domain
netsurf = NetworkSurface(CurvesU=flatten(filter), CurvesV=flatten(filter_2), Continuity=2)  # disabled
eval = EvaluateCurve(Curve=reparameterize(item_11), Parameter=number_slider_13)  # -> Point, Tangent, Angle; disabled
offsrf = OffsetSurface(Distance=number_slider_11, BothSides=True, CreateSolid=True)  # disabled
split_3 = SplitList(List=intcrv_4.Curve, Index=1)  # -> ListA, ListB
split_4 = SplitList(List=intcrv_3.Curve, Index=1)  # -> ListA, ListB
number_slider_14 = Slider(255, range=0..255)  # disabled
number_slider_15 = Slider(2, range=0..20)  # disabled
item_12 = ListItem(List=intcrv_3.Curve, Index=Slider(0, range=0..20), Wrap=True)
filter_3 = StreamFilter(Gate=u_cyclic_2, Stream0=intcrv_4.Curve, Stream1=split_3.ListB)
filter_4 = StreamFilter(Gate=v_cyclic_2, Stream0=intcrv_3.Curve, Stream1=split_4.ListB)
trim = TrimSolid(Shape=netsurf, Cutters=flatten(offsrf))  # disabled
mypreview = RGBPreview(G=netsurf, A=number_slider_14, N=number_slider_15)  # disabled
netsurf_2 = NetworkSurface(CurvesU=flatten(filter_3), CurvesV=flatten(filter_4), Continuity=2)  # -> reparameterize(Surface)
eval_2 = EvaluateCurve(Curve=reparameterize(item_12), Parameter=Slider(0.501, range=0..1))  # -> Point, Tangent, Angle
offsrf_2 = OffsetSurface(Surface=trim, Distance=number_slider_11, BothSides=True, CreateSolid=True)  # disabled
number_slider_16 = Slider(0.011, range=0..0.1)
number_slider_17 = Slider(20, range=0..30)
number_slider_18 = Slider(20, range=0..30)
dom_5 = ConstructDomain(DomainStart=0, DomainEnd=1)
dom_6 = ConstructDomain(DomainStart=0, DomainEnd=1)
dom_7 = ConstructDomain(DomainStart=0, DomainEnd=1)
range_7 = Range(Domain=dom_5, Steps=number_slider_17)
range_8 = Range(Domain=dom_6, Steps=number_slider_17)
range_9 = Range(Domain=dom_7, Steps=number_slider_17)
addition = Addition(A=range_7, B=number_slider_16)
subtraction = Subtraction(A=range_7, B=number_slider_16)
addition_2 = Addition(A=range_8, B=number_slider_16)
subtraction_2 = Subtraction(A=range_8, B=number_slider_16)
addition_3 = Addition(A=range_9, B=number_slider_16)
subtraction_3 = Subtraction(A=range_9, B=number_slider_16)
max = Maximum(A=addition, B=0)
max_2 = Maximum(A=subtraction, B=0)
max_3 = Maximum(A=addition_2, B=0)
max_4 = Maximum(A=subtraction_2, B=0)
max_5 = Maximum(A=addition_3, B=0)
max_6 = Maximum(A=subtraction_3, B=0)
min = Minimum(A=max_2, B=1)
min_2 = Minimum(A=max, B=1)
min_3 = Minimum(A=max_4, B=1)
min_4 = Minimum(A=max_3, B=1)
min_5 = Minimum(A=max_6, B=1)
min_6 = Minimum(A=max_5, B=1)
dom_8 = ConstructDomain(DomainStart=0, DomainEnd=1)
dom_9 = ConstructDomain(DomainStart=min, DomainEnd=min_2)
split_5 = SplitList(List=min_3, Index=1)  # -> ListA, ListB
split_6 = SplitList(List=min_4, Index=number_slider_17)  # -> ListA, ListB
dom_10 = ConstructDomain(DomainStart=min_5, DomainEnd=min_6)  # -> graft(Domain)
dom² = ConstructDomain²(DomainU=dom_9, DomainV=dom_8)  # -> flatten(_2DDomain)
dom_11 = ConstructDomain(DomainStart=0, DomainEnd=1)
dom_12 = ConstructDomain(DomainStart=split_5.ListB, DomainEnd=split_6.ListA)
dom²_2 = ConstructDomain²(DomainU=dom_12, DomainV=dom_10)  # -> flatten(_2DDomain)
subsrf = Isotrim(Surface=netsurf_2, Domain=graft([dom²_2, dom²]))  # -> flatten(Surface)
join = BrepJoin(Breps=subsrf)  # -> Breps, Closed
offsrf_3 = OffsetSurface(Surface=join.Breps, Distance=Slider(0.7, range=0..1), BothSides=True, CreateSolid=True)
mypreview_2 = RGBPreview(G=offsrf_3, A=Slider(255, range=0..255), N=Slider(2, range=0..20))

# ==== cluster Cluster
geo = ClusterInput()
N = ClusterInput()
N_2 = ClusterInput()
F = ClusterInput()
geo_2 = Geometry(geo)
paramptinrec = ParameterPointInRectangle(Rectangle=geo_2, ParameterX=0.5, ParameterY=0.5)  # -> Point, Normal
dom = ConstructDomain(DomainStart=0, DomainEnd=1)
range = Range(Domain=dom, Steps=N_2)
range_2 = Range(Domain=dom, Steps=N)
scale = Scale(Geometry=geo_2, Center=paramptinrec.Point, Factor=F)  # -> Geometry, Transform
paramrecgrid = ParameterRectangleGrid(Rectangle=scale.Geometry, ParametersX=range, ParametersY=range_2)  # -> Cells, Points
X = ClusterInput()
Y = ClusterInput()
Z = ClusterInput()
pdecon = Deconstruct(Point=paramrecgrid.Points)  # -> XComponent, YComponent, ZComponent
F_2 = ClusterInput()
python = GhPythonScript(X=X, Y=Y, Z=Z, u=pdecon.XComponent, v=pdecon.YComponent)  # -> out, pt
# ---------- python: Python ----------
__author__ = "will"
__version__ = "2020.07.21"

import rhinoscriptsyntax as rs
from math import sin, cos, exp, log, sqrt, sinh, cosh, tan, pi

#z = (x^2-sin(4*y)/3)

try:
    pt = rs.AddPoint([eval(X),eval(Y),eval(Z)])
except:
    pt = rs.AddPoint([0,0,0])
# ---------- end python ----------
scale_2 = Scale(Geometry=python.pt, Center=Point(0, 0, 0), Factor=F_2)  # -> Geometry, Transform
pt = Point(simplify(scale_2.Geometry))
path_mapper = PathMapper(pt, source="{A;B;C}(i)", target="{A;B;i}(C)")
intcrv = Interpolate(Vertices=path_mapper, Degree=3, Periodic=False, KnotStyle=1)  # -> Curve, Length, Domain
intcrv_2 = Interpolate(Vertices=pt, Degree=3, Periodic=False, KnotStyle=1)  # -> Curve, Length, Domain
path_mapper_2 = PathMapper(intcrv_2.Curve, source="{A;B;C}(i)", target="{C;i;A}(B)")
path_mapper_3 = PathMapper(intcrv.Curve, source="{A;B;C}(i)", target="{C;i;A}(B)")
trim = TrimTree(Tree=path_mapper_2, Depth=1)  # -> simplify(Tree)
trim_2 = TrimTree(Tree=path_mapper_3, Depth=1)  # -> simplify(Tree)
flip = FlipMatrix(Data=trim)
flip_2 = FlipMatrix(Data=trim_2)
item = ListItem(List=flip_2, Index=N_2, Wrap=True)
item_2 = ListItem(List=flip_2, Index=0, Wrap=True)
item_3 = ListItem(List=flip, Index=N_2, Wrap=True)
item_4 = ListItem(List=flip, Index=0, Wrap=True)
join = JoinCurves(Curves=[item_4, item_3, item_2, item], Preserve=False)
srfsplit = SurfaceSplit()
subsrf = Isotrim()
geo_3 = Geometry(join)
netsurf = NetworkSurface(CurvesU=flip, CurvesV=flip_2, Continuity=2)  # -> flatten(Surface)
geo_4 = ClusterOutput(geo_3)

# ==== cluster RGBPreview: Custom Preview clustered with RGB module with preset colors
N = ClusterInput()
python = GhPythonScript(N=N)  # -> out, R, G, B
# ---------- python: Python ----------
__author__ = "will"
__version__ = "2020.07.20"

import rhinoscriptsyntax as rs

colors=[(0,0,0),(255,255,255),(115,115,115),(255,0,0),(0,255,0),(0,0,255),(255,255,0),(255,0,255),(0,255,255),(0,162,255),(252,124,21),(124,51,202),(23,151,59),(255,80,90),(255,80,226),(32,214,255),(0,92,0),(0,0,120),(112,255,49),(138,78,0)]

N=int(N)
R = colors[N][0]
G = colors[N][1]
B = colors[N][2]
# ---------- end python ----------
A = ClusterInput()
G = ClusterInput()
rgb = ColourRGB(Alpha=A, Red=python.R, Green=python.G, Blue=python.B)
preview = CustomPreview(Geometry=G, Material=rgb)
