# Grasshopper definition parametrics.gh (Grasshopper 1.0.7)

number_slider = Slider(0, range=0..19)
number_slider_2 = Slider(0.053, range=0..1)
timer = Timer(TimerInterval=20, Target=button)  # disabled
number_slider_3 = Slider(8.05, range=0..20)
number_slider_4 = Slider(0.088, range=0..1)
button = Button()
panel = Panel("""(2+cos(1.5*t))*cos(t)
(2+cos(1.5*t))*sin(t)
sin(1.5*t)""")
panel_2 = Panel("""t*sin(t)/2
t*cos(t)/2
sqrt(t)""")
number_slider_5 = Slider(14.567, range=0..20)
number_slider_6 = Slider(0.116, range=0..1)
panel_3 = Panel("""sin(10*t)
t
log(t)""")
panel_4 = Panel("""3*cos(t)
2*sin(t)
3*cos(3*t)""")
panel_5 = Panel("""2*sin(t)
2*cos(t)
log(1+t)""")
number_slider_7 = Slider(0.132, range=0..1)
number_slider_8 = Slider(0.132, range=0..1)
number_slider_9 = Slider(14.567, range=0..20)
number_slider_10 = Slider(0.056, range=0..1)
number_slider_11 = Slider(0.116, range=0..1)
panel_6 = Panel("""2*sin(t)
3*exp(sin(2*t))
2*(cos(t))""")
number_slider_12 = Slider(0.132, range=0..1)
number_slider_13 = Slider(0.013, range=0..1)
dom = ConstructDomain(DomainStart=0.1, DomainEnd=12.56637061)
dom_2 = ConstructDomain(DomainStart=0, DomainEnd=12.56637061)
dom_3 = ConstructDomain(DomainStart=0, DomainEnd=31.41592654)
dom_4 = ConstructDomain(DomainStart=0, DomainEnd=12.56637061)
dom_5 = ConstructDomain(DomainStart=0, DomainEnd=12.56637061)
dom_6 = ConstructDomain(DomainStart=0, DomainEnd=18.84955592)
range = Range(Domain=dom, Steps=Slider(500, range=0..5000))
range_2 = Range(Domain=dom_2, Steps=Slider(93, range=0..100))
range_3 = Range(Domain=dom_3, Steps=Slider(93, range=0..100))
range_4 = Range(Domain=dom_5, Steps=Slider(93, range=0..100))
range_5 = Range(Domain=dom_6, Steps=Slider(93, range=0..100))
range_6 = Range(Domain=dom_4, Steps=Slider(500, range=0..500))
python = GhPythonScript(xyz=panel_3, t=range)  # -> out, p; inputs xyz: list
# ---------- python: Python ----------
__author__ = "will"
__version__ = "2020.08.13"

import rhinoscriptsyntax as rs
from math import sin, cos, exp, log, sqrt

x=eval(xyz[0])
y=eval(xyz[1])
z=eval(xyz[2])

p=rs.AddPoint([x,y,z])
# ---------- end python ----------
python_2 = GhPythonScript(xyz=panel_4, t=range_2)  # -> out, p; inputs xyz: list; same code as python
python_3 = GhPythonScript(xyz=panel_5, t=range_3)  # -> out, p; inputs xyz: list; same code as python
python_4 = GhPythonScript(xyz=panel, t=range_4)  # -> out, p; inputs xyz: list; same code as python
python_5 = GhPythonScript(xyz=panel_2, t=range_5)  # -> out, p; inputs xyz: list; same code as python
python_6 = GhPythonScript(xyz=panel_6, t=range_6)  # -> out, p; inputs xyz: list
# ---------- python_6: Python ----------
__author__ = "will"
__version__ = "2020.08.13"

import rhinoscriptsyntax as rs
from math import sin, cos, exp, log, sqrt, pi

x=eval(xyz[0])
y=eval(xyz[1])
z=eval(xyz[2])

p=rs.AddPoint([x,y,z])
# ---------- end python_6 ----------
intcrv = Interpolate(Vertices=python.p, Degree=3, Periodic=False, KnotStyle=1)  # -> Curve, Length, Domain
intcrv_2 = Interpolate(Vertices=python_2.p, Degree=3, Periodic=False, KnotStyle=1)  # -> Curve, Length, Domain
intcrv_3 = Interpolate(Vertices=python_3.p, Degree=3, Periodic=False, KnotStyle=1)  # -> Curve, Length, Domain
intcrv_4 = Interpolate(Vertices=python_4.p, Degree=3, Periodic=False, KnotStyle=1)  # -> Curve, Length, Domain
intcrv_5 = Interpolate(Vertices=python_5.p, Degree=3, Periodic=False, KnotStyle=1)  # -> Curve, Length, Domain
intcrv_6 = Interpolate(Vertices=python_6.p, Degree=3, Periodic=True, KnotStyle=1)  # -> Curve, Length, Domain
pipe = Pipe(Curve=intcrv.Curve, Radius=number_slider_2, Caps=0)
pipe_2 = Pipe(Curve=intcrv_2.Curve, Radius=number_slider_2, Caps=2)
pipe_3 = Pipe(Curve=intcrv_3.Curve, Radius=number_slider_2, Caps=2)
pipe_4 = Pipe(Curve=intcrv_4.Curve, Radius=number_slider_2, Caps=0)
pipe_5 = Pipe(Curve=intcrv_5.Curve, Radius=number_slider_2, Caps=2)
pipe_6 = Pipe(Curve=intcrv_6.Curve, Radius=number_slider_2, Caps=2)
pt = ConstructPoint(XCoordinate=Slider(-36, range=-50..50), YCoordinate=Slider(12, range=-50..50), ZCoordinate=Slider(0, range=-50..50))
pt_2 = Point(pt)
pt_3 = ConstructPoint(XCoordinate=Slider(-12, range=-50..50), YCoordinate=Slider(12, range=-50..50), ZCoordinate=Slider(0, range=-50..50))
pt_4 = Point(pt_3)
pt_5 = ConstructPoint(XCoordinate=Slider(-12, range=-50..50), YCoordinate=Slider(-12, range=-50..50), ZCoordinate=Slider(0, range=-50..50))
pt_6 = Point(pt_5)
pt_7 = ConstructPoint(XCoordinate=Slider(12, range=-50..50), YCoordinate=Slider(-12, range=-50..50), ZCoordinate=Slider(0, range=-50..50))
pt_8 = Point(pt_7)
pt_9 = ConstructPoint(XCoordinate=Slider(12, range=-50..50), YCoordinate=Slider(12, range=-50..50), ZCoordinate=Slider(0, range=-50..50))
pt_10 = Point(pt_9)
pt_11 = ConstructPoint(XCoordinate=Slider(-36, range=-50..50), YCoordinate=Slider(-12, range=-50..50), ZCoordinate=Slider(0, range=-50..50))
pt_12 = Point(pt_11)
move = Move(Geometry=pipe, Motion=pt_2)  # -> Geometry, Transform
move_2 = Move(Geometry=pipe_2, Motion=pt_4)  # -> Geometry, Transform
move_3 = Move(Geometry=pipe_3, Motion=pt_6)  # -> Geometry, Transform
move_4 = Move(Geometry=pipe_4, Motion=pt_8)  # -> Geometry, Transform
move_5 = Move(Geometry=pipe_5, Motion=pt_10)  # -> Geometry, Transform
move_6 = Move(Geometry=pipe_6, Motion=pt_12)  # -> Geometry, Transform
number_slider_14 = Slider(8, range=0..19)
number_slider_15 = Slider(0, range=0..19)
number_slider_16 = Slider(9, range=0..19)
number_slider_17 = Slider(8, range=0..19)
cluster = Cluster(pt=pt_7, num=number_slider_3, num_2=number_slider_4, T="F", refresh=button)
mypreview = RGBPreview(G=move_4.Geometry, A=Slider(255, range=0..255), N=number_slider)
cluster_2 = Cluster(pt=pt_9, num=number_slider_3, num_2=number_slider_4, T="C", refresh=button)
cluster_3 = Cluster(pt=pt_11, num=number_slider_3, num_2=number_slider_4, T="D", refresh=button)
mypreview_2 = RGBPreview(G=move_5.Geometry, A=Slider(255, range=0..255), N=number_slider)
mypreview_3 = RGBPreview(G=move_6.Geometry, A=Slider(255, range=0..255), N=number_slider)
cluster_4 = Cluster(pt=pt_3, num=number_slider_3, num_2=number_slider_4, T="B", refresh=button)
mypreview_4 = RGBPreview(G=move_3.Geometry, A=Slider(255, range=0..255), N=number_slider)
mypreview_5 = RGBPreview(G=move_2.Geometry, A=Slider(255, range=0..255), N=number_slider)
cluster_5 = Cluster(pt=pt_5, num=number_slider_3, num_2=number_slider_4, T="E", refresh=button)
cluster_6 = Cluster(pt=pt, num=number_slider_3, num_2=number_slider_4, T="A", refresh=button)
mypreview_6 = RGBPreview(G=move.Geometry, A=Slider(255, range=0..255), N=number_slider)

# ==== cluster RGBPreview: Custom Preview clustered with RGB module with preset colors
N = ClusterInput()
python = GhPythonScript(N=N)  # -> out, R, G, B
# ---------- python: Python ----------
__author__ = "will"
__version__ = "2020.07.20"

import rhinoscriptsyntax as rs

colors=[(0,0,0),(255,255,255),(115,115,115),(255,0,0),(0,255,0),(0,0,255),(255,255,0),(255,0,255),(0,255,255),(0,162,255),(252,124,21),(124,51,202),(23,151,59),(255,80,90),(255,80,226),(32,214,255),(0,92,0),(0,0,120),(112,255,49),(138,78,0)]

N=int(N)
R = colors[N][0]
G = colors[N][1]
B = colors[N][2]
# ---------- end python ----------
A = ClusterInput()
G = ClusterInput()
rgb = ColourRGB(Alpha=A, Red=python.R, Green=python.G, Blue=python.B)
preview = CustomPreview(Geometry=G, Material=rgb)

# ==== cluster Cluster
num = ClusterInput()
T = ClusterInput()
num_2 = ClusterInput()
pt = ClusterInput()
refresh = ClusterInput()
num_3 = Number(num)
num_4 = Number(num_2)
pt_2 = Point(pt)
neg = Negative(Value=num_3)
multiplication = Multiplication(A=num_3, B=0.75)
neg_2 = Negative(Value=num_3)
neg_3 = Negative(Value=num_3)
multiplication_2 = Multiplication(A=neg_3, B=0.75)
multiplication_3 = Multiplication(A=num_3, B=2)
multiplication_4 = Multiplication(A=num_3, B=2)
multiplication_5 = Multiplication(A=num_3, B=2)
pt_3 = ConstructPoint(XCoordinate=0, YCoordinate=0, ZCoordinate=num_3)
pt_4 = ConstructPoint(XCoordinate=0, YCoordinate=0, ZCoordinate=neg)
pt_5 = ConstructPoint(XCoordinate=0, YCoordinate=num_3, ZCoordinate=0)
pt_6 = ConstructPoint(XCoordinate=0, YCoordinate=neg_2, ZCoordinate=0)
pt_7 = ConstructPoint(XCoordinate=num_3, YCoordinate=0, ZCoordinate=0)
pt_8 = ConstructPoint(XCoordinate=neg_3, YCoordinate=0, ZCoordinate=0)
X = UnitX(Factor=1)
Y = UnitY(Factor=1)
Z = UnitZ(Factor=1)
pt_9 = ConstructPoint(XCoordinate=multiplication, YCoordinate=multiplication_2, ZCoordinate=multiplication)
addition = Addition(A=pt_4, B=pt_2)
addition_2 = Addition(A=pt_3, B=pt_2)
addition_3 = Addition(A=pt_6, B=pt_2)
addition_4 = Addition(A=pt_5, B=pt_2)
addition_5 = Addition(A=pt_7, B=pt_2)
addition_6 = Addition(A=pt_2, B=pt_9)
addition_7 = Addition(A=pt_8, B=pt_2)
line = LineSDL(Start=addition, Direction=Z, Length=multiplication_3)
line_2 = LineSDL(Start=addition_3, Direction=Y, Length=multiplication_4)
line_3 = LineSDL(Start=addition_7, Direction=X, Length=multiplication_5)
yz = YZPlane(Origin=addition_6)
xy = XYPlane(Origin=addition_2)
num_5 = Number(num_4)
xz = XZPlane(Origin=addition_4)
num_6 = Number(num_4)
num_7 = Number(num_4)
yz_2 = YZPlane(Origin=addition_5)
orient2camera = Ladybug_OrientToCamera(initPosition=yz, refresh=refresh)  # -> orientedToCam; plug-in component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
pipe = Pipe(Curve=line, Radius=num_5, Caps=0)
flippln = FlipPlane(Plane=xz, FlipX=False, FlipY=False, FlipZ=True)  # -> Flipped, R
pipe_2 = Pipe(Curve=line_2, Radius=num_6, Caps=0)
pipe_3 = Pipe(Curve=line_3, Radius=num_7, Caps=0)
multiplication_6 = Multiplication(A=num_5, B=3)
multiplication_7 = Multiplication(A=num_6, B=3)
multiplication_8 = Multiplication(A=num_7, B=3)
multiplication_9 = Multiplication(A=num_5, B=12)
multiplication_10 = Multiplication(A=num_6, B=12)
multiplication_11 = Multiplication(A=num_7, B=12)
cone = Cone(Base=xy, Radius=multiplication_6, Length=multiplication_9)  # -> Cone, Tip
cone_2 = Cone(Base=flippln.Flipped, Radius=multiplication_7, Length=multiplication_10)  # -> Cone, Tip
cone_3 = Cone(Base=yz_2, Radius=multiplication_8, Length=multiplication_11)  # -> Cone, Tip
mypreview = RGBPreview(G=[cone.Cone, pipe], A=Slider(255, range=0..255), N=Slider(5, range=0..19))
mypreview_2 = RGBPreview(G=[cone_3.Cone, pipe_3], A=Slider(255, range=0..255), N=Slider(3, range=0..19))
mypreview_3 = RGBPreview(G=[cone_2.Cone, pipe_2], A=Slider(255, range=0..255), N=Slider(12, range=0..19))
tag = TextTag3D(Location=orient2camera, Text=T, Size=multiplication_11, Justification=7)
