# Grasshopper definition quadric_cross-sections.gh (Grasshopper 1.0.7)
# plug-ins: Pufferfish

number_slider = Slider(2.558, range=-3.315..3.315)
y_z_plane = BooleanToggle(True)
trace = BooleanToggle(True)
y_z_plane_2 = BooleanToggle(False)
trace_2 = BooleanToggle(False)
trace_3 = BooleanToggle(False)
x_z_plane = BooleanToggle(False)
trace_4 = BooleanToggle(False)
x_z_plane_2 = BooleanToggle(True)
z_c_plane = BooleanToggle(False)
x_y_plane = BooleanToggle(False)
trace_5 = BooleanToggle(False)
trace_6 = BooleanToggle(True)
x_y_plane_2 = BooleanToggle(True)
trace_7 = BooleanToggle(True)
number_slider_2 = Slider(4.219, range=0..10)
number_slider_3 = Slider(2.556, range=0..10)
number_slider_4 = Slider(1.732, range=0..10)
multiplication = Multiplication(A=number_slider, B=5)
number_slider_5 = Slider(3.326, range=0..10)
number_slider_6 = Slider(3.302, range=0..10)
roundd = RoundToDecimalPlace(NumberX=multiplication, DecimalPlace=2, RoundType=0)  # -> Rounded, Difference
neg = Negative(Value=number_slider_2)
neg_2 = Negative(Value=number_slider_3)
neg_3 = Negative(Value=number_slider_4)
txt = Text("z=")
txt_2 = Text(roundd.Rounded)
Y = UnitY(Factor=1)
txt_3 = Text("x=0")
X = UnitX(Factor=1)
txt_4 = Text("y=0")
txt_5 = Text("z=0")
Z = UnitZ(Factor=1)
dom = ConstructDomain(DomainStart=number_slider_2, DomainEnd=neg)
neg_4 = Negative(Value=number_slider)
dom_2 = ConstructDomain(DomainStart=number_slider_3, DomainEnd=neg_2)
neg_5 = Negative(Value=number_slider_6)
Y_2 = UnitY(Factor=1)
X_2 = UnitX(Factor=1)
txt_6 = Text("x=0")
txt_7 = Text("y=0")
txt_8 = Text("z=0")
dom_3 = ConstructDomain(DomainStart=number_slider_4, DomainEnd=neg_3)
Z_2 = UnitZ(Factor=1)
neg_6 = Negative(Value=number_slider_5)
pt = ConstructPoint(XCoordinate=-15, YCoordinate=30, ZCoordinate=multiplication)
pt_2 = ConstructPoint(XCoordinate=0, YCoordinate=0, ZCoordinate=multiplication)
Z_3 = UnitZ(Factor=1)
pl = PlaneNormal(Origin=Point(0, 0, 0), ZAxis=Y)
pl_2 = PlaneNormal(Origin=Point(0, 0, 0), ZAxis=X)
dispatch = Dispatch(List=txt_3, DispatchPattern=y_z_plane)  # -> ListA, ListB
dispatch_2 = Dispatch(List=txt_4, DispatchPattern=x_z_plane_2)  # -> ListA, ListB
pl_3 = PlaneNormal(Origin=Point(0, 0, 0), ZAxis=Z)
dispatch_3 = Dispatch(List=txt_5, DispatchPattern=x_y_plane_2)  # -> ListA, ListB
dom_4 = ConstructDomain(DomainStart=number_slider, DomainEnd=neg_4)
dom_5 = ConstructDomain(DomainStart=number_slider_6, DomainEnd=neg_5)
join = TextJoin(Text=[txt, txt_2])
pl_4 = PlaneNormal(Origin=Point(0, 0, 0), ZAxis=Y_2)
pl_5 = PlaneNormal(Origin=Point(0, 0, 0), ZAxis=X_2)
dom_6 = ConstructDomain(DomainStart=number_slider_5, DomainEnd=neg_6)
dispatch_4 = Dispatch(List=txt_6, DispatchPattern=y_z_plane_2)  # -> ListA, ListB
dispatch_5 = Dispatch(List=txt_7, DispatchPattern=x_z_plane)  # -> ListA, ListB
pl_6 = PlaneNormal(Origin=Point(0, 0, 0), ZAxis=Z_2)
dispatch_6 = Dispatch(List=txt_8, DispatchPattern=x_y_plane)  # -> ListA, ListB
geo = Geometry(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)
range = Range(Domain=dom, Steps=Slider(20, range=0..40))
range_2 = Range(Domain=dom_2, Steps=Slider(20, range=0..40))
range_3 = Range(Domain=dom_3, Steps=Slider(20, range=0..40))
pl_7 = PlaneNormal(Origin=pt_2, ZAxis=Z_3)
pl_8 = PlaneNormal(Origin=pt, ZAxis=Z_3)
dispatch_7 = Dispatch(List=join, DispatchPattern=z_c_plane)  # -> ListA, ListB
range_4 = Range(Domain=dom_4, Steps=Slider(20, range=0..40))
range_5 = Range(Domain=dom_5, Steps=Slider(20, range=0..40))
dispatch_8 = Dispatch(List=pl, DispatchPattern=x_z_plane_2)  # -> ListA, ListB
dispatch_9 = Dispatch(List=pl_2, DispatchPattern=y_z_plane)  # -> ListA, ListB
dispatch_10 = Dispatch(List=geo, DispatchPattern=Toggle(True))  # -> ListA, ListB
dispatch_11 = Dispatch(List=pl_3, DispatchPattern=x_y_plane_2)  # -> ListA, ListB
range_6 = Range(Domain=dom_6, Steps=Slider(16, range=0..40))
geo_2 = Geometry([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])
dispatch_12 = Dispatch(List=pl_4, DispatchPattern=x_z_plane)  # -> ListA, ListB
dispatch_13 = Dispatch(List=pl_5, DispatchPattern=y_z_plane_2)  # -> ListA, ListB
dispatch_14 = Dispatch(List=pl_6, DispatchPattern=x_y_plane)  # -> ListA, ListB
prot = RotatePlane(Plane=pl_8, Angle=3.141592654)
geo_3 = Geometry(dispatch_10.ListA)
python = GhPythonScript(y=range)  # -> out, x
# ---------- python: Python ----------
__author__ = "will"
__version__ = "2020.07.18"

import rhinoscriptsyntax as rs

x=4-(4.0/9.0)*(y**2)
# ---------- end python ----------
dispatch_15 = Dispatch(List=geo_2, DispatchPattern=Toggle(False))  # -> ListA, ListB
python_2 = GhPythonScript(z=range_2)  # -> out, x
# ---------- python_2: Python ----------
__author__ = "will"
__version__ = "2020.07.18"

import rhinoscriptsyntax as rs

x = 4-(4.0/3.0)*(z**2)
# ---------- end python_2 ----------
multiplication_2 = Multiplication(A=range_5, B=1.414213562)
tag = TextTag3D(
    Location=Plane(origin=(22, 0, 26), x=(-1, 0, 0), y=(0, 0, 1)),
    Text=dispatch_2.ListA,
    Size=3,
    Colour=RGB(235, 175, 66),
    Justification=7)
tag_2 = TextTag3D(Location=PlaneYZ(0, 15, 25), Text=dispatch.ListA, Size=3, Colour=RGB(52, 219, 22), Justification=7)
python_3 = GhPythonScript(z=range_3)  # -> out, yp, ym
# ---------- python_3: Python ----------
__author__ = "will"
__version__ = "2020.07.18"

import rhinoscriptsyntax as rs
from math import sqrt


yp = sqrt(9-3*(z**2))
ym = -sqrt(9-3*(z**2))
# ---------- end python_3 ----------
tag_3 = TextTag3D(
    Location=Plane(origin=(22, 26, 0), x=(-1, 0, 0), y=(0, 0.07387168552, 0.9972677545)),
    Text=dispatch_3.ListA,
    Size=3,
    Colour=RGB(176, 49, 149),
    Justification=7)
python_4 = GhPythonScript(y=range_4, c=number_slider)  # -> out, px, mx
# ---------- python_4: Python ----------
__author__ = "will"
__version__ = "2020.07.18"

import rhinoscriptsyntax as rs
from math import sqrt

px = sqrt(2*c**2 - 2*(y**2))
mx = -sqrt(2*c**2 - 2*(y**2))
# ---------- end python_4 ----------
number_slider_7 = Slider(23.338, range=0..30)
dispatch_16 = Dispatch(List=pl_7, DispatchPattern=z_c_plane)  # -> ListA, ListB
tag_4 = TextTag3D(
    Location=Plane(origin=(22, 0, 26), x=(-1, 0, 0), y=(0, 0, 1)),
    Text=dispatch_5.ListA,
    Size=3,
    Colour=RGB(235, 175, 66),
    Justification=7)
tag_5 = TextTag3D(Location=PlaneYZ(0, 15, 25), Text=dispatch_4.ListA, Size=3, Colour=RGB(52, 219, 22), Justification=7)
tag_6 = TextTag3D(
    Location=Plane(origin=(22, 26, 0), x=(-1, 0, 0), y=(0, 0.07387168552, 0.9972677545)),
    Text=dispatch_6.ListA,
    Size=3,
    Colour=RGB(176, 49, 149),
    Justification=7)
number_slider_8 = Slider(23.338, range=0..30)
neg_7 = Negative(Value=range_6)
geo_4 = Geometry(dispatch_15.ListA)
neg_8 = Negative(Value=multiplication_2)
tag_7 = TextTag3D(Location=prot, Text=dispatch_7.ListA, Size=3, Colour=RGB(8, 110, 212), Justification=7)
pt_3 = ConstructPoint(XCoordinate=python_2.x, YCoordinate=0, ZCoordinate=range_2)
pt_4 = ConstructPoint(XCoordinate=python.x, YCoordinate=range, ZCoordinate=0)
pt_5 = ConstructPoint(XCoordinate=0, YCoordinate=python_3.yp, ZCoordinate=range_3)
pt_6 = ConstructPoint(XCoordinate=0, YCoordinate=python_3.ym, ZCoordinate=range_3)
flippln = FlipPlane(Plane=dispatch_11.ListA, FlipX=False, FlipY=False, FlipZ=True)  # -> Flipped, R
flippln_2 = FlipPlane(Plane=dispatch_8.ListA, FlipX=False, FlipY=True, FlipZ=False)  # -> Flipped, R
flippln_3 = FlipPlane(Plane=dispatch_9.ListA, FlipX=True, FlipY=False, FlipZ=False)  # -> Flipped, R
neg_9 = Negative(Value=number_slider_7)
pt_7 = ConstructPoint(XCoordinate=multiplication_2, YCoordinate=0, ZCoordinate=range_5)
pt_8 = ConstructPoint(XCoordinate=neg_8, YCoordinate=0, ZCoordinate=range_5)
pt_9 = ConstructPoint(XCoordinate=0, YCoordinate=range_6, ZCoordinate=range_6)
flippln_4 = FlipPlane(Plane=dispatch_16.ListA, FlipX=False, FlipY=False, FlipZ=True)  # -> Flipped, R
flippln_5 = FlipPlane(Plane=dispatch_14.ListA, FlipX=False, FlipY=False, FlipZ=True)  # -> Flipped, R
pt_10 = ConstructPoint(XCoordinate=0, YCoordinate=neg_7, ZCoordinate=range_6)
pt_11 = ConstructPoint(XCoordinate=python_4.px, YCoordinate=range_4, ZCoordinate=number_slider)
pt_12 = ConstructPoint(XCoordinate=python_4.mx, YCoordinate=range_4, ZCoordinate=number_slider)
flippln_6 = FlipPlane(Plane=dispatch_12.ListA, FlipX=False, FlipY=True, FlipZ=False)  # -> Flipped, R
flippln_7 = FlipPlane(Plane=dispatch_13.ListA, FlipX=True, FlipY=False, FlipZ=False)  # -> Flipped, R
neg_10 = Negative(Value=number_slider_8)
multiplication_3 = Multiplication(A=pt_4, B=Slider(5, range=0..20))
multiplication_4 = Multiplication(A=pt_3, B=Slider(5, range=0..20))
multiplication_5 = Multiplication(A=pt_5, B=Slider(5, range=0..20))
multiplication_6 = Multiplication(A=pt_6, B=Slider(5, range=0..20))
dom_7 = ConstructDomain(DomainStart=number_slider_7, DomainEnd=neg_9)
dom_8 = ConstructDomain(DomainStart=number_slider_8, DomainEnd=neg_10)
pt_13 = Point(multiplication_3)
multiplication_7 = Multiplication(A=pt_7, B=Slider(5, range=0..20))
pt_14 = Point(multiplication_4)
multiplication_8 = Multiplication(A=pt_8, B=Slider(5, range=0..20))
multiplication_9 = Multiplication(A=pt_9, B=Slider(5, range=0..20))
pt_15 = Point(multiplication_5)
multiplication_10 = Multiplication(A=pt_11, B=Slider(5, range=0..20))
multiplication_11 = Multiplication(A=pt_12, B=Slider(5, range=0..20))
multiplication_12 = Multiplication(A=pt_10, B=Slider(5, range=0..20))
pt_16 = Point(multiplication_6)
pt_17 = Point(multiplication_9)
intcrv = Interpolate(Vertices=pt_14, Degree=3, Periodic=False, KnotStyle=1)  # -> Curve, Length, Domain
pt_18 = Point(multiplication_10)
pt_19 = Point(multiplication_11)
intcrv_2 = Interpolate(Vertices=pt_13, Degree=3, Periodic=False, KnotStyle=1)  # -> Curve, Length, Domain
pt_20 = Point(multiplication_12)
planesrf = PlaneSurface(Plane=flippln_2.Flipped, XSize=dom_7, YSize=dom_7)
planesrf_2 = PlaneSurface(Plane=flippln_3.Flipped, XSize=dom_7, YSize=dom_7)
planesrf_3 = PlaneSurface(Plane=flippln.Flipped, XSize=dom_7, YSize=dom_7)
intcrv_3 = Interpolate(Vertices=pt_16, Degree=3, Periodic=False, KnotStyle=1)  # -> Curve, Length, Domain
intcrv_4 = Interpolate(Vertices=pt_15, Degree=3, Periodic=False, KnotStyle=1)  # -> Curve, Length, Domain
pt_21 = Point(multiplication_7)
pt_22 = Point(multiplication_8)
planesrf_4 = PlaneSurface(Plane=flippln_6.Flipped, XSize=dom_8, YSize=dom_8)
planesrf_5 = PlaneSurface(Plane=flippln_7.Flipped, XSize=dom_8, YSize=dom_8)
planesrf_6 = PlaneSurface(Plane=flippln_4.Flipped, XSize=dom_8, YSize=dom_8)
planesrf_7 = PlaneSurface(Plane=flippln_5.Flipped, XSize=dom_8, YSize=dom_8)
intcrv_5 = Interpolate(Vertices=pt_18, Degree=3, Periodic=False, KnotStyle=1)  # -> Curve, Length, Domain
intcrv_6 = Interpolate(Vertices=pt_19, Degree=3, Periodic=False, KnotStyle=1)  # -> Curve, Length, Domain
intcrv_7 = Interpolate(Vertices=pt_21, Degree=3, Periodic=False, KnotStyle=1)  # -> Curve, Length, Domain
intcrv_8 = Interpolate(Vertices=pt_22, Degree=3, Periodic=False, KnotStyle=1)  # -> Curve, Length, Domain
join_2 = JoinCurves(Curves=[intcrv_4.Curve, intcrv_3.Curve], Preserve=False)
intcrv_9 = Interpolate(Vertices=pt_20, Degree=3, Periodic=False, KnotStyle=1)  # -> Curve, Length, Domain
intcrv_10 = Interpolate(Vertices=pt_17, Degree=3, Periodic=False, KnotStyle=1)  # -> Curve, Length, Domain
number_slider_9 = Slider(148, range=0..255)
number_slider_10 = Slider(0, range=0..255)
number_slider_11 = Slider(134, range=0..255)
number_slider_12 = Slider(255, range=0..255)
number_slider_13 = Slider(194, range=0..255)
number_slider_14 = Slider(15, range=0..255)
number_slider_15 = Slider(185, range=0..255)
number_slider_16 = Slider(0, range=0..255)
number_slider_17 = Slider(0, range=0..255)
number_slider_18 = Slider(0, range=0..255)
number_slider_19 = Slider(192, range=0..255)
number_slider_20 = Slider(148, range=0..255)
number_slider_21 = Slider(134, range=0..255)
number_slider_22 = Slider(194, range=0..255)
number_slider_23 = Slider(0, range=0..255)
number_slider_24 = Slider(243, range=0..255)
number_slider_25 = Slider(255, range=0..255)
number_slider_26 = Slider(15, range=0..255)
number_slider_27 = Slider(185, range=0..255)
number_slider_28 = Slider(0, range=0..255)
number_slider_29 = Slider(0, range=0..255)
join_3 = JoinCurves(Curves=[intcrv_5.Curve, intcrv_6.Curve], Preserve=False)
dispatch_17 = Dispatch(List=intcrv_2.Curve, DispatchPattern=trace_7)  # -> ListA, ListB
dispatch_18 = Dispatch(List=intcrv.Curve, DispatchPattern=trace_6)  # -> ListA, ListB
join_4 = JoinCurves(Curves=[intcrv_7.Curve, intcrv_8.Curve], Preserve=False)
join_5 = JoinCurves(Curves=[intcrv_10.Curve, intcrv_9.Curve], Preserve=False)
dispatch_19 = Dispatch(List=graft(join_2), DispatchPattern=trace)  # -> ListA, ListB
dispatch_20 = Dispatch(List=join_3, DispatchPattern=trace_4)  # -> ListA, ListB
dispatch_21 = Dispatch(List=join_4, DispatchPattern=trace_2)  # -> ListA, ListB
dispatch_22 = Dispatch(List=graft(join_5), DispatchPattern=trace_3)  # -> ListA, ListB
rgb = ColourRGB(Alpha=Slider(80, range=0..255), Red=number_slider_9, Green=number_slider_10, Blue=number_slider_11)
rgb_2 = ColourRGB(Alpha=Slider(89, range=0..255), Red=number_slider_12, Green=number_slider_13, Blue=number_slider_14)
rgb_3 = ColourRGB(Alpha=Slider(85, range=0..255), Red=number_slider_16, Green=number_slider_15, Blue=number_slider_17)
number_slider_30 = Slider(0.25, range=0..1)
rgb_4 = ColourRGB(Alpha=Slider(80, range=0..255), Red=number_slider_23, Green=number_slider_19, Blue=number_slider_24)
rgb_5 = ColourRGB(Alpha=Slider(80, range=0..255), Red=number_slider_20, Green=number_slider_18, Blue=number_slider_21)
rgb_6 = ColourRGB(Alpha=Slider(89, range=0..255), Red=number_slider_25, Green=number_slider_22, Blue=number_slider_26)
rgb_7 = ColourRGB(Alpha=Slider(85, range=0..255), Red=number_slider_28, Green=number_slider_27, Blue=number_slider_29)
number_slider_31 = Slider(0.25, range=0..1)
preview = CustomPreview(Geometry=planesrf_3, Material=rgb)
preview_2 = CustomPreview(Geometry=planesrf, Material=rgb_2)
preview_3 = CustomPreview(Geometry=planesrf_2, Material=rgb_3)
pipe = Pipe(Curve=dispatch_20.ListA, Radius=number_slider_31, Caps=0)
preview_4 = CustomPreview(Geometry=planesrf_6, Material=rgb_4)
preview_5 = CustomPreview(Geometry=planesrf_7, Material=rgb_5)
preview_6 = CustomPreview(Geometry=planesrf_4, Material=rgb_6)
preview_7 = CustomPreview(Geometry=planesrf_5, Material=rgb_7)
pipe_2 = Pipe(Curve=dispatch_17.ListA, Radius=number_slider_30, Caps=0)
pipe_3 = Pipe(Curve=dispatch_18.ListA, Radius=number_slider_30, Caps=0)
pipe_4 = Pipe(Curve=dispatch_19.ListA, Radius=number_slider_30, Caps=0)
sph = Sphere(Base=PlaneXY(0, 0, 0), Radius=0.5)
pipe_5 = Pipe(Curve=dispatch_21.ListA, Radius=number_slider_31, Caps=0)
pipe_6 = Pipe(Curve=dispatch_22.ListA, Radius=number_slider_31, Caps=0)
dispatch_23 = Dispatch(List=sph, DispatchPattern=trace_5)  # -> ListA, ListB
rgb_8 = ColourRGB(Alpha=Slider(255, range=0..255), Red=number_slider_9, Green=number_slider_10, Blue=number_slider_11)
rgb_9 = ColourRGB(Alpha=Slider(255, range=0..255), Red=number_slider_12, Green=number_slider_13, Blue=number_slider_14)
rgb_10 = ColourRGB(Alpha=Slider(255, range=0..255), Red=number_slider_16, Green=number_slider_15, Blue=number_slider_17)
rgb_11 = ColourRGB(Alpha=Slider(255, range=0..255), Red=number_slider_23, Green=number_slider_19, Blue=number_slider_24)
rgb_12 = ColourRGB(Alpha=Slider(255, range=0..255), Red=number_slider_25, Green=number_slider_22, Blue=number_slider_26)
rgb_13 = ColourRGB(Alpha=Slider(255, range=0..255), Red=number_slider_28, Green=number_slider_27, Blue=number_slider_29)
preview_8 = CustomPreview(Geometry=pipe_2, Material=rgb_8)
preview_9 = CustomPreview(Geometry=pipe_3, Material=rgb_9)
preview_10 = CustomPreview(Geometry=pipe_4, Material=rgb_10)
rgb_14 = ColourRGB(Alpha=Slider(255, range=0..255), Red=number_slider_20, Green=number_slider_18, Blue=number_slider_21)
preview_11 = CustomPreview(Geometry=pipe, Material=rgb_11)
preview_12 = CustomPreview(Geometry=pipe_5, Material=rgb_12)
preview_13 = CustomPreview(Geometry=pipe_6, Material=rgb_13)
preview_14 = CustomPreview(Geometry=dispatch_23.ListA, Material=rgb_14)
