# Grasshopper definition sphere_and_cylinders.gh (Grasshopper 1.0.7)

isocurves = BooleanToggle(True)
number_slider = Slider(161.111, range=0..500)
surface = BooleanToggle(True)
number_slider_2 = Slider(5.656, range=0..10)
number_slider_3 = Slider(1.918, range=0..10)
md_slider = MDSlider(
    SliderMode=0,
    slider_value=Point(0.9452166674, 0.6564331055, 0.5),
    x_domain=Domain(0, 1),
    y_domain=Domain(0, 1),
    z_domain=Domain(0, 1))
isocurves_2 = BooleanToggle(False)
sphere = BooleanToggle(False)
point = BooleanToggle(False)
python = GhPythonScript(x=Slider(4, range=-1..4))  # -> out, circle, sin, xsin, curve, sq
# ---------- python: Python ----------
__author__ = "will"
__version__ = "2020.07.16"

import rhinoscriptsyntax as rs

if x == 1:
    sin = True
    circle = False
    xsin = False
    curve = False
    sq = False
    

if x == 0:
    sin = False
    circle = True
    xsin = False
    curve = False
    sq = False
    

if x == 2:
    sin = False
    circle = False
    xsin = True
    curve = False
    sq = False
    

if x == 3:
    sin = False
    circle = False
    xsin = False
    curve = True
    sq = False
    

if x == 4:
    sin = False
    circle = False
    xsin = False
    curve = False
    sq = True
# ---------- end python ----------
neg = Negative(Value=number_slider_3)
number_slider_4 = Slider(7.51, range=0..10)
dom = ConstructDomain(DomainStart=neg, DomainEnd=number_slider_3)
neg_2 = Negative(Value=number_slider_2)
neg_3 = Negative(Value=number_slider_4)
range = Range(Domain=dom, Steps=Slider(100, range=0..100))
dom_2 = ConstructDomain(DomainStart=neg_2, DomainEnd=number_slider_2)
dom_3 = ConstructDomain(DomainStart=neg_3, DomainEnd=number_slider_4)
ellipse = Ellipse(Plane=PlaneXY(0, 0, 0), Radius1=Slider(49.81, range=0..100), Radius2=Slider(51.466, range=0..100))  # -> Ellipse, Focus1, Focus2
range_2 = Range(Domain=dom_2, Steps=Slider(44, range=0..100))
python_2 = GhPythonScript(x=range)  # -> out, z
# ---------- python_2: Python ----------
__author__ = "will"
__version__ = "2020.07.16"

import rhinoscriptsyntax as rs

from math import sin, cos, tan

z = x**2
# ---------- end python_2 ----------
range_3 = Range(Domain=dom_3, Steps=Slider(100, range=0..100))
python_3 = GhPythonScript(x=range_2)  # -> out, y
# ---------- python_3: Python ----------
__author__ = "will"
__version__ = "2020.07.16"

import rhinoscriptsyntax as rs

from math import sin, cos, tan

y = sin(x)
# ---------- end python_3 ----------
pt = ConstructPoint(XCoordinate=range, YCoordinate=0, ZCoordinate=python_2.z)
python_4 = GhPythonScript(x=range_3)  # -> out, y
# ---------- python_4: Python ----------
__author__ = "will"
__version__ = "2020.07.16"

import rhinoscriptsyntax as rs

from math import sin, cos, tan

y = x*sin(x)
# ---------- end python_4 ----------
sph = Sphere(Base=PlaneXY(0, 0, 0), Radius=Slider(35.852, range=0..100))  # -> reparameterize(Sphere)
pt_2 = ConstructPoint(XCoordinate=range_2, YCoordinate=python_3.y, ZCoordinate=0)
crv = Curve(ellipse.Ellipse)
multiplication = Multiplication(A=pt, B=Slider(18.988, range=0..100))
dispatch = Dispatch(List=sph, DispatchPattern=sphere)  # -> ListA, ListB
pt_3 = ConstructPoint(XCoordinate=range_3, YCoordinate=python_4.y, ZCoordinate=0)
geo = Geometry(dispatch.ListA)
multiplication_2 = Multiplication(A=pt_2, B=Slider(13.322, range=0..100))
cluster = Cluster(N=Slider(13, range=0..30), N_2=Slider(8, range=0..30))
dispatch_2 = Dispatch(List=geo, DispatchPattern=isocurves_2)  # -> ListA, ListB
intcrv = Interpolate(Vertices=multiplication, Degree=3, Periodic=False, KnotStyle=1)  # -> Curve, Length, Domain
multiplication_3 = Multiplication(A=pt_3, B=Slider(8.877, range=0..100))
crv_2 = Curve(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)
iso = IsoCurve(Surface=dispatch_2.ListA, UVPoint=cluster)  # -> UIsocurve, VIsocurve
intcrv_2 = Interpolate(Vertices=multiplication_2, Degree=3, Periodic=False, KnotStyle=1)  # -> Curve, Length, Domain
intcrv_3 = Interpolate(Vertices=multiplication_3, Degree=3, Periodic=False, KnotStyle=1)  # -> Curve, Length, Domain
dispatch_3 = Dispatch(List=intcrv.Curve, DispatchPattern=python.sq)  # -> ListA, ListB
dispatch_4 = Dispatch(List=intcrv_3.Curve, DispatchPattern=python.xsin)  # -> ListA, ListB
dispatch_5 = Dispatch(List=crv, DispatchPattern=python.circle)  # -> ListA, ListB
dispatch_6 = Dispatch(List=crv_2, DispatchPattern=python.curve)  # -> ListA, ListB
dispatch_7 = Dispatch(List=intcrv_2.Curve, DispatchPattern=python.sin)  # -> ListA, ListB
evalsrf = EvaluateSurface(Surface=geo, Point=md_slider)  # -> Point, Normal, UDirection, VDirection, Frame
crv_3 = Curve([dispatch_7.ListA, dispatch_5.ListA, dispatch_6.ListA, dispatch_4.ListA])
preview = CustomPreview(
    Geometry=[iso.UIsocurve, iso.VIsocurve],
    Material={diffuse=RGB(221, 160, 221), emission=RGB(66, 48, 66), shine=0.5, specular=RGB(255, 255, 255), transparency=0})
pt_4 = Point(evalsrf.Point)
Z = UnitZ(Factor=1)
sph_2 = Sphere(Base=evalsrf.Frame, Radius=Slider(0.948, range=0..1))
dispatch_8 = Dispatch(List=crv_3, DispatchPattern=surface)  # -> ListA, ListB
multiplication_4 = Multiplication(A=Z, B=number_slider)
dispatch_9 = Dispatch(List=sph_2, DispatchPattern=point)  # -> ListA, ListB
Y = UnitY(Factor=number_slider)
pl = PlaneNormal(Origin=Point(0, 0, 0), ZAxis=Y)
rgb = ColourRGB(
    Alpha=Slider(255, range=0..255),
    Red=Slider(9, range=0..255),
    Green=Slider(127, range=0..255),
    Blue=Slider(255, range=0..255))
planesrf = PlaneSurface(Plane=pl, XSize=Domain(0, 70), YSize=Domain(-50, 50))
dispatch_10 = Dispatch(List=dispatch_3.ListA, DispatchPattern=surface)  # -> ListA, ListB
neg_4 = Negative(Value=multiplication_4)
preview_2 = CustomPreview(Geometry=dispatch_9.ListA, Material=rgb)
extr = Extrude(Base=dispatch_8.ListA, Direction=multiplication_4)
extr_2 = Extrude(Base=dispatch_8.ListA, Direction=neg_4)
dispatch_11 = Dispatch(List=planesrf, DispatchPattern=python.sq)  # -> ListA, ListB
neg_5 = Negative(Value=Y)
mypreview = RGBPreview(G=dispatch_11.ListA, A=Slider(36, range=0..255), N=Slider(2, range=0..19))
extr_3 = Extrude(Base=dispatch_10.ListA, Direction=Y)
extr_4 = Extrude(Base=dispatch_10.ListA, Direction=neg_5)
cluster_2 = Cluster(N=Slider(10, range=0..30), N_2=Slider(30, range=0..30))
join = BrepJoin(Breps=[extr, extr_2])  # -> Breps, Closed
cluster_3 = Cluster(N=Slider(10, range=0..30), N_2=Slider(30, range=0..30))
iso_2 = IsoCurve(Surface=reparameterize(extr_2), UVPoint=cluster_2)  # -> UIsocurve, VIsocurve
join_2 = BrepJoin(Breps=[extr_3, extr_4])  # -> Breps, Closed
iso_3 = IsoCurve(Surface=reparameterize(extr), UVPoint=cluster_2)  # -> UIsocurve, VIsocurve
iso_4 = IsoCurve(Surface=reparameterize(extr_4), UVPoint=cluster_3)  # -> UIsocurve, VIsocurve
iso_5 = IsoCurve(Surface=reparameterize(extr_3), UVPoint=cluster_3)  # -> UIsocurve, VIsocurve
geo_2 = Geometry([iso_2.UIsocurve, iso_3.UIsocurve])
geo_3 = Geometry([iso_4.UIsocurve, iso_5.UIsocurve])
dispatch_12 = Dispatch(List=geo_2, DispatchPattern=isocurves)  # -> ListA, ListB
dispatch_13 = Dispatch(List=geo_3, DispatchPattern=isocurves)  # -> ListA, ListB
rgb_2 = ColourRGB(
    Alpha=Slider(141, range=0..255),
    Red=Slider(184, range=0..255),
    Green=Slider(211, range=0..255),
    Blue=Slider(255, range=0..255))
preview_3 = CustomPreview(Geometry=dispatch_12.ListA, Material=rgb_2)
rgb_3 = ColourRGB(
    Alpha=Slider(141, range=0..255),
    Red=Slider(184, range=0..255),
    Green=Slider(211, range=0..255),
    Blue=Slider(255, range=0..255))
preview_4 = CustomPreview(Geometry=dispatch_13.ListA, Material=rgb_3)

# ==== cluster Cluster
dom = ConstructDomain(DomainStart=0, DomainEnd=1)
dom_2 = ConstructDomain(DomainStart=0, DomainEnd=1)
N = ClusterInput()
N_2 = ClusterInput()
range = Range(Domain=dom, Steps=N)
range_2 = Range(Domain=dom_2, Steps=N_2)
pt = ConstructPoint(XCoordinate=range, YCoordinate=range_2, ZCoordinate=0)
pt_2 = ClusterOutput(pt)

# ==== cluster RGBPreview: Custom Preview clustered with RGB module with preset colors
N = ClusterInput()
python = GhPythonScript(N=N)  # -> out, R, G, B
# ---------- python: Python ----------
__author__ = "will"
__version__ = "2020.07.20"

import rhinoscriptsyntax as rs

colors=[(0,0,0),(255,255,255),(115,115,115),(255,0,0),(0,255,0),(0,0,255),(255,255,0),(255,0,255),(0,255,255),(0,162,255),(252,124,21),(124,51,202),(23,151,59),(255,80,90),(255,80,226),(32,214,255),(0,92,0),(0,0,120),(112,255,49),(138,78,0)]

N=int(N)
R = colors[N][0]
G = colors[N][1]
B = colors[N][2]
# ---------- end python ----------
A = ClusterInput()
G = ClusterInput()
rgb = ColourRGB(Alpha=A, Red=python.R, Green=python.G, Blue=python.B)
preview = CustomPreview(Geometry=G, Material=rgb)
