# Grasshopper definition surface_plotter.gh (Grasshopper 1.0.7)
# plug-ins: Pufferfish

# ----
# Controls
# Graph
# Evaluation point(s)
# Derivatives
# Contours
# Traces
# Choose function to graph (from editable list below)
# Toggle Dynamic Labels
# (warning: turning this on may cause
# delays depending on your GPU)
# Hit this button to make labels face you (but not dynamically)
# You may want to scale the z-direction so that your graph looks nice.
# Size on the grid on the Rhino plane.
# Resolution of grid of points sample to make
# graph. Increase for graph with a lot of detail.
# More points = slower to compute.
# Set to True to use these sliders to set X and Y domains.
# Set to False to use the domain list above.
# Choose a boundary curve to define domain.
# Default (0) is none. (1) is circle. (2) is user defined.
# Toggle XY-grid on ground and on surface,
# and translucent ground plane.
show_surface = BooleanToggle(True)
show_point_on_graph = BooleanToggle(False)
contour_cutting_planes = BooleanToggle(False)
eval_on_grid_of_pts = BooleanToggle(False)
grid_size = Slider(5, range=0..20)
contour_plot = BooleanToggle(True)
level_curves_on_graph = BooleanToggle(True)
num_contours = Slider(30, range=0..30)
# Tangent Plane
show_tangent_plane = BooleanToggle(False)
function = Slider(0, range=0..10)
panel = Panel("""15*sin(exp(x))*cos(y)+20
(y-x)*(sin(x-2))+(x-2)*y
(x**3)+(y**2)+x*y+8
(x*y**2)/(x**2+y**4)
(exp(x))/((y)**2+(x)**2+.01)
(x*y)/(x**2+y**2)
sqrt(50-2*x**2-3*y**2)
sqrt(4-x**2-y**2)""")
x_partial_tangent_line = BooleanToggle(False)
directional_unit_tangent = BooleanToggle(False)
gradient = BooleanToggle(True)
labels_toward_camera = Button()
z_scaling = Slider(1.498, range=0..50)
grid_resolution = Slider(40, range=10..500)
x_max = Slider(8, range=-20..20)
# (double click)
timer = Timer(TimerInterval=50, Target=[orient2camera_3, orient2camera_2, orient2camera])  # disabled
y_partial_tangent_line = BooleanToggle(False)
z_trace = BooleanToggle(False)
z_trace_height = Slider(-0.04913, range=-1..1)
xy_size = Slider(50, range=-50..50)
use_sliders_for_domain = BooleanToggle(False)
x_min = Slider(0, range=-20..20)
y_min = Slider(0, range=-20..20)
y_max = Slider(7, range=-20..20)
x_trace = BooleanToggle(False)
y_trace = BooleanToggle(False)
domain_clipping_curve = Slider(0, range=0..2)
ground_plane_at_z_min = BooleanToggle(True)
ground_plane = BooleanToggle(True)
ground_grid = BooleanToggle(False)
grid_on_surface = BooleanToggle(False)
z_trace_plane = BooleanToggle(False)
x_trace_plane = BooleanToggle(False)
y_trace_plane = BooleanToggle(False)
highlight_next_level_curve = Button(ExpressionNormal="0", ExpressionPressed="1")
# Evaluation point
md_slider = MDSlider(
    SliderMode=0,
    slider_value=Point(0.7553122532, 0.6133006873, 0.5),
    x_domain=Domain(-1, 1),
    y_domain=Domain(-1, 1),
    z_domain=Domain(0, 1))
# Domain for corresponding function
panel_2 = Panel("""[-4,2,-5,10]
[-10,10,-10,10]
[-2,2,-2,2]
[-5,5,-5,5]
[-4,4,-8,8]
[-5,5,-5,5]
[-5/sqrt(2),5/sqrt(2),-5/sqrt(3),5/sqrt(3)]
[0,2,0,3.1415]""")
# Axis labels
panel_3 = Panel("how much cat has eaten")
# Directional derivative direction
md_slider_2 = MDSlider(
    SliderMode=0,
    slider_value=Point(0.1617352187, 0.5827309213, 0.5),
    x_domain=Domain(-1, 1),
    y_domain=Domain(-1, 1),
    z_domain=Domain(0, 1))
y_axis_label = BooleanToggle(False)
z_axis_label = BooleanToggle(False)
x_axis_label = BooleanToggle(False)
rec = DataRecorder(highlight_next_level_curve, DataLimit=-10, RecordData=True)
dispatch = Dispatch(List=panel_3, DispatchPattern=x_axis_label)  # -> XLabel, ListB
dispatch_2 = Dispatch(List="how much cat has played", DispatchPattern=y_axis_label)  # -> YLabel, ListB
dispatch_3 = Dispatch(List="how much cat will sleep", DispatchPattern=z_axis_label)  # -> ZLabel, ListB
item = ListItem(List=panel, Index=function, Wrap=True)
item_2 = ListItem(List=panel_2, Index=function, Wrap=True)

nudge_contours = Slider(1.06475, range=-2..2)
directional_trace = BooleanToggle(False)
user_defined_clipping_curve = Curve(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)
unitize = BooleanToggle(True)
directional_plane = BooleanToggle(False)
direction = Point(md_slider_2)
# Settings
xy_pos = Point(md_slider)

# ----
# Grid of Points
pt = ConstructPoint(XCoordinate=1, YCoordinate=1, ZCoordinate=0)
dom = ConstructDomain(DomainStart=-1, DomainEnd=1)
rec_2pt = Rectangle2Pt(Plane=PlaneXY(0, 0, 0), PointA=pt, PointB=Point(0, 0, 0), Radius=0)  # -> Rectangle, Length
range = Range(Domain=dom, Steps=grid_size)
paramrecgrid = ParameterRectangleGrid(Rectangle=rec_2pt.Rectangle, ParametersX=range, ParametersY=range)  # -> Cells, Points
filter = StreamFilter(Gate=eval_on_grid_of_pts, Stream0=xy_pos, Stream1=paramrecgrid.Points)

direction_vector_opacity = Slider(255, range=0..255)
direction_vector_color = Slider(0, range=0..19)
grad_directional_thickness = Slider(0.192, range=0..1)
directional_tangent_opacity = Slider(255, range=0..255)
directional_tangent_color = Slider(4, range=0..19)
grad_directional_length = Slider(1, range=1..10)
gradient_opacity = Slider(255, range=0..255)
gradient_color = Slider(1, range=0..19)

tangent_plane_opacity = Slider(80, range=0..255)
tangent_plane_size = Slider(12, range=0..50)
tangent_plane_color = Slider(14, range=0..19)
point_opacity = Slider(255, range=0..255)
point_color = Slider(3, range=0..19)

graph_opacity = Slider(113, range=0..255)
graph_color = Slider(9, range=0..19)
ground_grid_opacity = Slider(255, range=0..255)
ground_grid_color = Slider(0, range=0..19)
clipping_circle_radius = Slider(35.584, range=0..50)
surface_grid_opacity = Slider(82, range=0..255)
surface_grid_color = Slider(1, range=0..19)
ground_plane_opacity = Slider(28, range=0..255)
ground_plane_color = Slider(0, range=0..19)

bounding_axes_thickness = Slider(0.069, range=0..1)
z_label_offset = Slider(5.26, range=0..10)
x_label_offset = Slider(5.247, range=0..10)
y_label_offset = Slider(4.983, range=0..10)

f_y_tangent_color = Slider(3, range=0..19)
f_x_tangent_opacity = Slider(255, range=0..255)
f_y_tangent_opacity = Slider(255, range=0..255)
tangent_line_length = Slider(25.62, range=0..30)
tangent_line_thickness = Slider(0.2, range=0..1)
f_x_tangent_color = Slider(3, range=0..19)

trace_thickness = Slider(0.052, range=0..1)
x_trace_opacity = Slider(255, range=0..255)
x_trace_color = Slider(0, range=0..19)
y_trace_opacity = Slider(255, range=0..255)
y_trace_color = Slider(0, range=0..19)
z_trace_opacity = Slider(255, range=0..255)
z_trace_color = Slider(0, range=0..19)
cross_section_plane_opacity = Slider(79, range=0..255)
cross_section_plane_color = Slider(1, range=0..19)
dir_trace_opacity = Slider(255, range=0..255)
dir_trace_color = Slider(0, range=0..19)

# ----
# Domain and Placement
cir = Circle(Plane=PlaneXY(0, 0, 0), ClippingCircleRadius=clipping_circle_radius)
no_clipping = Curve(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)
filter_2 = StreamFilter(SelectClippingCurve=domain_clipping_curve, Stream0=no_clipping, Stream1=cir, Stream2=user_defined_clipping_curve)
filter_3 = StreamFilter(Gate=use_sliders_for_domain, Stream0=item_2, Stream1=[x_min, x_max, y_min, y_max])
python = GhPythonScript(domain=filter_3)  # -> out, X_min, X_max, Y_min, Y_max; inputs domain: list
# ---------- python: Python ----------
__author__ = "will"
__version__ = "2020.07.23"

import rhinoscriptsyntax as rs
from math import sqrt

if len(domain)==1:
    domain = domain[0]

if isinstance(domain,str):
    L = eval(domain)

else:
    L = domain
    
X_min,X_max = L[0],L[1]
Y_min,Y_max = L[2],L[3]
# ---------- end python ----------
clipping_curve = Curve(filter_2)
domain_and_placement = DomainAndPlacement(num_5=xy_size, num=python.X_min, num_3=python.X_max, num_2=python.Y_min, num_4=python.Y_max)  # -> x_scaling, y_scaling, move, x_domain_size, y_domain_size, x_axis_labels, y_axis_labels, nx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

# ----
# Point on Graph
point_on_graph = PointOnGraph(
    or_toggle_point=[show_tangent_plane, x_partial_tangent_line, y_partial_tangent_line, directional_unit_tangent, gradient, show_point_on_graph],
    xy_coords=filter,
    xy_size=xy_size,
    function=item,
    x_scaling=domain_and_placement.x_scaling,
    y_scaling=domain_and_placement.y_scaling,
    toggle_point=show_point_on_graph,
    z_scaling=z_scaling,
    trans=domain_and_placement.move)  # -> A, S, pt_3, A_2
mypreview = RGBPreview(G=[point_on_graph.S, point_on_graph.A_2], A=point_opacity, N=point_color)

# ----
# Graph Points and Grids
graph_from_points = GraphFromPoints(
    theta_min=0,
    theta_max=1,
    z_scaling=z_scaling,
    xy_size=xy_size,
    clipping_curve=clipping_curve,
    grid_res=grid_resolution,
    x_scaling=domain_and_placement.x_scaling,
    y_scaling=domain_and_placement.y_scaling,
    function=item,
    trans=domain_and_placement.move)  # -> E, crv_3, z_scaled, z_vals, graph
grids = Grids(
    L=graph_from_points.graph,
    toggle_surface_grid=grid_on_surface,
    ground_grid=graph_from_points.crv_3,
    toggle_ground_grid=ground_grid)  # -> P, A
cluster = Cluster_4(N=graph_from_points.z_scaled)  # -> z_off_center_2, z_max, z_min, z_width_2
mypreview_2 = RGBPreview(G=grids.A, A=ground_grid_opacity, N=ground_grid_color)
mypreview_3 = RGBPreview(G=grids.P, A=surface_grid_opacity, N=surface_grid_color)

# ----
# Ground Plane and Bounding Axes
x_y_z_offset_axes = XYZOffsetAxes(
    R=bounding_axes_thickness,
    num_5=z_scaling,
    lx=domain_and_placement.lx,
    num=cluster.z_max,
    num_9=domain_and_placement.nx,
    num_2=cluster.z_min,
    A=xy_size,
    ly=domain_and_placement.ly,
    num_8=domain_and_placement.ny,
    N=graph_from_points.z_vals)  # -> pt_9, P, P_3, P_2, labels, P_4
orient2camera = Ladybug_OrientToCamera(initPosition=x_y_z_offset_axes.P_3, refresh=labels_toward_camera)  # -> orientedToCam; plug-in component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
orient2camera_2 = Ladybug_OrientToCamera(initPosition=x_y_z_offset_axes.P_2, refresh=labels_toward_camera)  # -> orientedToCam; plug-in component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
gound_plane = GoundPlane(P=x_y_z_offset_axes.pt_9, G=ground_plane_at_z_min, xy_size=xy_size, toggle_ground_plane=ground_plane)  # -> A, P_2
orient2camera_3 = Ladybug_OrientToCamera(initPosition=x_y_z_offset_axes.P_4, refresh=labels_toward_camera)  # -> orientedToCam; plug-in component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
mypreview_4 = RGBPreview(G=gound_plane.A, A=ground_plane_opacity, N=ground_plane_color)
x_labels = XLabels(pln=orient2camera, T=dispatch.XLabel, B=x_label_offset, int=domain_and_placement.x_axis_labels)
y_labels = YLabels(pln=orient2camera_2, T=dispatch_2.YLabel, B=y_label_offset, int=domain_and_placement.y_axis_labels)
z_labels = ZLabels(oriented_plane=orient2camera_3, z_axis_tick_labels=x_y_z_offset_axes.labels, B=z_label_offset, T=dispatch_3.ZLabel)
mypreview_5 = RGBPreview(G=x_y_z_offset_axes.P, A=Slider(255, range=0..255), N=Slider(0, range=0..19))

geo = Geometry(point_on_graph.S)

# ----
# Tangent Plane
tangent_plane = TangentPlane(P_2=show_tangent_plane, geo=graph_from_points.graph, P=point_on_graph.pt_3, B=tangent_plane_size)
mypreview_6 = RGBPreview(G=tangent_plane, A=tangent_plane_opacity, N=tangent_plane_color)

clip_graph = ClipGraph(z_min=cluster.z_min, graph=graph_from_points.graph, clipping_curve=clipping_curve, toggle_graph=show_surface)  # -> i, A
mypreview_7 = RGBPreview(G=clip_graph.A, A=graph_opacity, N=graph_color)

# ----
# X,Y,Z Traces and Contours
x_y_z_trace_cutting_planes = XYZTraceCuttingPlanes(
    int_2=[x_trace, x_trace_plane, y_partial_tangent_line, directional_unit_tangent, gradient],
    num_12=domain_and_placement.x_domain_size,
    num=xy_size,
    x_max=python.X_max,
    num_2=cluster.z_min,
    num_3=cluster.z_max,
    x_y_pos=filter,
    num_11=domain_and_placement.y_domain_size,
    y_max=python.Y_max,
    int=[directional_unit_tangent, y_trace_plane, x_partial_tangent_line, y_trace, gradient],
    A=z_trace_height,
    B_3=cluster.z_width_2,
    B_4=cluster.z_off_center_2,
    B_5=z_scaling,
    int_5=[z_trace, z_trace_plane],
    V=direction,
    B_2=domain_and_placement.x_scaling,
    B=domain_and_placement.y_scaling,
    int_7=[directional_plane, directional_trace, directional_unit_tangent])  # -> A_3, P, R_2, A_2, P_2, R_3, G, R, A_4, A_5
dispatch_4 = Dispatch(List=x_y_z_trace_cutting_planes.G, ToggleZTracePlane=z_trace_plane)  # -> ListA, ListB
dispatch_5 = Dispatch(List=x_y_z_trace_cutting_planes.P_2, ToggleYTracePlane=y_trace_plane)  # -> ListA, ListB
dispatch_6 = Dispatch(List=x_y_z_trace_cutting_planes.P, ToggleXTracePlane=x_trace_plane)  # -> ListA, ListB
x_y_z_traces = XYZTraces(
    I=rec,
    A_4=x_y_z_trace_cutting_planes.A_3,
    A_2=x_y_z_trace_cutting_planes.A_2,
    A_3=x_y_z_trace_cutting_planes.A_4,
    geo=clip_graph.i,
    R=trace_thickness,
    A=x_y_z_trace_cutting_planes.A_5)  # -> P, x_trace, y_trace, x_trace_piped, y_trace_piped, z_trace_piped, dir_trace_piped, dir_trace
tag = TextTag3D(Location=dispatch_6.ListA, Text=x_y_z_trace_cutting_planes.R_2, Size=3, Colour=RGB(0, 0, 0), Justification=7)
tag_2 = TextTag3D(Location=dispatch_5.ListA, Text=x_y_z_trace_cutting_planes.R_3, Size=3, Colour=RGB(0, 0, 0), Justification=7)
tag_3 = TextTag3D(Location=dispatch_4.ListA, Text=x_y_z_trace_cutting_planes.R, Size=3, Colour=RGB(0, 0, 0), Justification=7)
dispatch_7 = Dispatch(List=x_y_z_trace_cutting_planes.A_4, ToggleZTracePlane=z_trace_plane)  # -> ListA, ListB
dispatch_8 = Dispatch(List=x_y_z_trace_cutting_planes.A_3, ToggleXTracePlane=x_trace_plane)  # -> ListA, ListB
dispatch_9 = Dispatch(List=x_y_z_trace_cutting_planes.A_5, DirectionalPlane=directional_plane)  # -> ListA, ListB
dispatch_10 = Dispatch(List=x_y_z_trace_cutting_planes.A_2, ToggleYTracePlane=y_trace_plane)  # -> ListA, ListB
level_curves_and_contours = LevelCurvesAndContours(
    xy_size=xy_size,
    toggle_level_planes=contour_cutting_planes,
    nudge=nudge_contours,
    z_width_2=cluster.z_width_2,
    num_contours=num_contours,
    z_off_center_2=cluster.z_off_center_2,
    toggle_contours=contour_plot,
    graph=clip_graph.i,
    B=gound_plane.P_2,
    toggle_level_curves=level_curves_on_graph)  # -> A, A_2, C
mypreview_8 = RGBPreview(
    G=[dispatch_8.ListA, dispatch_10.ListA, dispatch_7.ListA, dispatch_9.ListA],
    A=cross_section_plane_opacity,
    N=cross_section_plane_color)
mypreview_9 = RGBPreview(G=x_y_z_traces.P, A=Slider(255, range=0..255), N=Slider(6, range=0..19))
dispatch_11 = Dispatch(List=x_y_z_traces.y_trace_piped, DispatchPattern=y_trace)  # -> ListA, ListB
dispatch_12 = Dispatch(List=x_y_z_traces.x_trace_piped, DispatchPattern=x_trace)  # -> ListA, ListB
dispatch_13 = Dispatch(List=x_y_z_traces.z_trace_piped, DispatchPattern=z_trace)  # -> ListA, ListB
dispatch_14 = Dispatch(List=x_y_z_traces.dir_trace_piped, DispatchPattern=directional_trace)  # -> ListA, ListB
mypreview_10 = RGBPreview(G=dispatch_14.ListA, A=dir_trace_opacity, N=dir_trace_color)
mypreview_11 = RGBPreview(G=dispatch_11.ListA, A=y_trace_opacity, N=y_trace_color)
mypreview_12 = RGBPreview(G=dispatch_12.ListA, A=x_trace_opacity, N=x_trace_color)
mypreview_13 = RGBPreview(G=dispatch_13.ListA, A=z_trace_opacity, N=z_trace_color)
mypreview_14 = RGBPreview(G=level_curves_and_contours.A_2, A=Slider(255, range=0..255), N=Slider(1, range=0..19))
mypreview_15 = RGBPreview(G=level_curves_and_contours.A, A=Slider(79, range=0..255), N=Slider(1, range=0..19))
mypreview_16 = RGBPreview(G=level_curves_and_contours.C, A=Slider(255, range=0..255), N=Slider(0, range=0..19))

# ----
# Partial Deriv. Tangents
pt_2 = Point(point_on_graph.pt_3)
f_y_tangent = F_YTangent(
    B=domain_and_placement.y_scaling,
    P_2=pt_2,
    crv=x_y_z_traces.x_trace,
    int=[y_partial_tangent_line, directional_unit_tangent, gradient],
    P=y_partial_tangent_line,
    L=tangent_line_length,
    R=tangent_line_thickness)  # -> f_y, R_2, P_3
f_x_tangent = F_XTangent(
    B=domain_and_placement.x_scaling,
    pt=pt_2,
    crv=x_y_z_traces.y_trace,
    int=[x_partial_tangent_line, directional_unit_tangent, gradient],
    P=x_partial_tangent_line,
    L=tangent_line_length,
    R=tangent_line_thickness)  # -> D, f_x_unit_tangent, f_x_tangent_line
mypreview_17 = RGBPreview(G=f_y_tangent.P_3, A=f_y_tangent_opacity, N=f_y_tangent_color)
mypreview_18 = RGBPreview(G=f_x_tangent.f_x_tangent_line, A=f_x_tangent_opacity, N=f_x_tangent_color)

# ----
# Gradient & Directional
gradient_and_directional = GradientAndDirectional(
    G=unitize,
    A_4=f_x_tangent.D,
    A_2=f_y_tangent.f_y,
    A=f_x_tangent.f_x_unit_tangent,
    A_3=f_y_tangent.R_2,
    P_2=gradient,
    x_scaling=domain_and_placement.x_scaling,
    num_3=domain_and_placement.y_scaling,
    pt=point_on_graph.A,
    V=direction,
    basepoint=pt_2,
    num=grad_directional_thickness,
    num_2=grad_directional_length,
    P=directional_unit_tangent)  # -> geo_3, geo_2, geo
mypreview_19 = RGBPreview(G=gradient_and_directional.geo_2, A=directional_tangent_opacity, N=directional_tangent_color)
mypreview_20 = RGBPreview(G=gradient_and_directional.geo, A=direction_vector_opacity, N=direction_vector_color)
mypreview_21 = RGBPreview(G=gradient_and_directional.geo_3, A=gradient_opacity, N=gradient_color)

# ==== cluster RGBPreview: Custom Preview clustered with RGB module with preset colors
N = ClusterInput()
A = ClusterInput()
python = GhPythonScript(N=N)  # -> out, R, G, B
# ---------- python: Python ----------
__author__ = "will"
__version__ = "2020.07.20"

import rhinoscriptsyntax as rs

colors=[(0,0,0),(255,255,255),(115,115,115),(255,0,0),(0,255,0),(0,0,255),(255,255,0),(255,0,255),(0,255,255),(0,162,255),(252,124,21),(124,51,202),(23,151,59),(255,80,90),(255,80,226),(32,214,255),(0,92,0),(0,0,120),(112,255,49),(138,78,0)]

N=int(N)
R = colors[N][0]
G = colors[N][1]
B = colors[N][2]
# ---------- end python ----------
G = ClusterInput()
rgb = ColourRGB(Alpha=A, Red=python.R, Green=python.G, Blue=python.B)
preview = CustomPreview(Geometry=G, Material=rgb)

# ==== cluster DomainAndPlacement
num = ClusterInput()
num_2 = ClusterInput()
num_3 = ClusterInput()
num_4 = ClusterInput()
num_5 = ClusterInput()
num_6 = Number(num_2)
num_7 = Number(num_3)
num_8 = Number(num_4)
num_9 = Number(num)
num_10 = Number(num_5)
addition = Addition(A=num_7, B=num_9)
subtraction = Subtraction(A=num_7, B=num_9)
addition_2 = Addition(A=num_8, B=num_6)
subtraction_2 = Subtraction(A=num_8, B=num_6)
division = Division(A=addition_2, B=2)
division_2 = Division(A=addition, B=2)
multiplication = Multiplication(A=num_10, B=2)
y_domain_size = ClusterOutput(subtraction_2)
x_domain_size = ClusterOutput(subtraction)
division_3 = Division(A=subtraction, B=multiplication)
division_4 = Division(A=subtraction_2, B=multiplication)
python = GhPythonScript(Rx=subtraction, Ry=subtraction_2, Xmin=num_9, Ymin=num_6)  # -> out, Nx, Ny, Lx, Ly, Xmax, Ymax
# ---------- python: Python ----------
__author__ = "will"
__version__ = "2020.07.24"

import rhinoscriptsyntax as rs
from math import floor

Fx=(int(Rx/16)+1)
Fy=(int(Ry/16)+1)

Nx = floor(Rx/Fx)
Ny = floor(Ry/Fy)

Lx = ((100/Rx)*Fx)*Nx
Ly = ((100/Ry)*Fy)*Ny

Xmax = Nx*Fx + Xmin
Ymax = Ny*Fy + Ymin
# ---------- end python ----------
neg = Negative(Value=num_10)
dom = ConstructDomain(DomainStart=num_6, DomainEnd=python.Ymax)
dom_2 = ConstructDomain(DomainStart=num_9, DomainEnd=python.Xmax)
multiplication_2 = Multiplication(A=division_3, B=neg)
multiplication_3 = Multiplication(A=division_4, B=neg)
y_scaling = ClusterOutput(division_4)
x_scaling = ClusterOutput(division_3)
range = Range(Domain=dom, Steps=python.Ny)
range_2 = Range(Domain=dom_2, Steps=python.Nx)
pt = ConstructPoint(XCoordinate=num_9, YCoordinate=num_6, ZCoordinate=0)
pt_2 = ConstructPoint(XCoordinate=multiplication_2, YCoordinate=multiplication_3, ZCoordinate=0)
multiplication_4 = Multiplication(A=division_3, B=division_2)
multiplication_5 = Multiplication(A=division_4, B=division)
y_axis_labels = ClusterOutput(range)
x_axis_labels = ClusterOutput(range_2)
nx = ClusterOutput(python.Nx)
ny = ClusterOutput(python.Ny)
ly = ClusterOutput(python.Ly)
lx = ClusterOutput(python.Lx)
vec2pt = Vector2Pt(PointA=pt_2, PointB=pt, Unitize=False)  # -> Vector, Length
move = ClusterOutput(vec2pt.Vector)

# ==== cluster GraphFromPoints
theta_min = ClusterInput()
theta_max = ClusterInput()
xy_size = ClusterInput()
dom = ConstructDomain(DomainStart=theta_min, DomainEnd=theta_max)
xy_size_2 = Number(xy_size)
dom_2 = ConstructDomain(DomainStart=0, DomainEnd=xy_size_2)
neg = Negative(Value=xy_size_2)
grid_res = ClusterInput()
grid_res_2 = Number(grid_res)
subtraction = Subtraction(A=xy_size_2, B=neg)
range = Range(Domain=dom, Steps=grid_res_2)
range_2 = Range(Domain=dom_2, Steps=grid_res_2)
pt = ConstructPoint(XCoordinate=neg, YCoordinate=neg, ZCoordinate=0)
xy = XYPlane(Origin=Point(0, 0, 0))
z_scaling = ClusterInput()
pt_2 = PointCylindrical(BasePlane=PlaneXY(0, 0, 0), Angle=graft(range), Radius=range_2, Elevation=0)  # disabled
pl_origin = PlaneOrigin(Base=xy, Origin=pt)
division = Division(A=subtraction, B=grid_res_2)
division_2 = Division(A=subtraction, B=grid_res_2)
z_scaling_2 = Number(z_scaling)
vec = VectorXYZ(XComponent=division_2, YComponent=division, ZComponent=0)  # -> Vector, Length
x_scaling = ClusterInput()
y_scaling = ClusterInput()
recgrid = Rectangular(Plane=pl_origin, SizeX=division_2, SizeY=division, ExtentX=grid_res_2, ExtentY=grid_res_2)  # -> Cells, Points
division_3 = Division(A=vec.Vector, B=2)
scale_nu = ScaleNU(Geometry=recgrid.Points, Plane=PlaneXY(0, 0, 0), XScaling=x_scaling, YScaling=y_scaling, ScaleZ=1)  # -> Geometry, Transform
trans = ClusterInput()
cluster = Cluster(T=pt_2, grid_res=grid_res_2)  # disabled
crv = Curve(recgrid.Cells)
cluster_2 = Cluster_2(T=pt_2, grid_res=grid_res_2)  # disabled
move = Move(Geometry=scale_nu.Geometry, Motion=trans)  # -> Geometry, Transform
neg_2 = Negative(Value=division_3)
clipping_curve = ClusterInput()
boundary = BoundarySurfaces(Edges=crv)
pdecon = Deconstruct(Point=move.Geometry)  # -> XComponent, YComponent, ZComponent
function = ClusterInput()
incurve = PointInCurve(Point=recgrid.Points, ClippingCurve=clipping_curve)  # -> Relationship, Point
python = GhPythonScript(x=pdecon.XComponent, y=pdecon.YComponent, function=function)  # -> out, z
# ---------- python: Python ----------
__author__ = "will"
__version__ = "2020.07.21"

import rhinoscriptsyntax as rs
from math import sin, cos, exp, log, sqrt, sinh, cosh, tan

#z = (x^2-sin(4*y)/3)

try:
    z = eval(function)
except:
    z = 0
# ---------- end python ----------
pdecon_2 = Deconstruct(Point=recgrid.Points)  # -> XComponent, YComponent, ZComponent
move_2 = Move(Geometry=boundary, Motion=neg_2)  # -> Geometry, Transform
pt_3 = ConstructPoint(XCoordinate=pdecon_2.XComponent, YCoordinate=pdecon_2.YComponent, ZCoordinate=python.z)
scale_nu_2 = ScaleNU(Geometry=pt_3, Plane=PlaneXY(0, 0, 0), ScaleX=1, ScaleY=1, ScaleZ=z_scaling_2)  # -> Geometry, Transform
pdecon_3 = Deconstruct(Point=scale_nu_2.Geometry)  # -> XComponent, YComponent, ZComponent
dispatch = Dispatch(List=pt_3, DispatchPattern=incurve.Relationship)  # -> ListA, ListB
addition = Addition(A=grid_res_2, B=1)
pt_4 = ConstructPoint(XCoordinate=0, YCoordinate=0, ZCoordinate=pdecon_3.ZComponent)
srfgrid = SurfaceFromPoints(Points=flatten(pt_3), UCount=addition, Interpolate=False)
pdecon_4 = Deconstruct(Point=dispatch.ListA)  # -> XComponent, YComponent, ZComponent
ln = Line(StartPoint=pt_4, EndPoint=Point(0, 0, 0))
scale_nu_3 = ScaleNU(Geometry=srfgrid, Plane=PlaneXY(0, 0, 0), ScaleX=1, ScaleY=1, ScaleZ=z_scaling_2)  # -> Geometry, Transform
multiplication = Multiplication(A=pdecon_4.ZComponent, B=z_scaling_2)
dom_3 = ConstructDomain(DomainStart=0, DomainEnd=19)
z_scaled = ClusterOutput(multiplication)
z_vals = ClusterOutput(pdecon_4.ZComponent)
subset = SubList(List=ln, Domain=dom_3, Wrap=True)  # -> List, Index
rebsrf = RebuildSurface(Surface=scale_nu_3.Geometry)  # disabled
flip = FlipMatrix(Data=subset.List)
cluster_3 = Cluster_3(pt=recgrid.Points, grid_res=grid_res_2)
subset_2 = SubList(List=flip, Domain=dom_3, Wrap=True)  # -> List, Index
graph = ClusterOutput(scale_nu_3.Geometry)
flip_2 = FlipMatrix(Data=subset_2.List)
crv_2 = Curve(cluster_3)
extrude = ExtrudeLinear(Profile=boundary, OrientationP=PlaneXY(0, 0, 0), Axis=flip_2)
E = ClusterOutput(extrude)
crv_3 = ClusterOutput(crv_2)

# ==== cluster Cluster_4
N = ClusterInput()
hilonums = HighestLowestNumbers(Numbers=flatten(N))  # -> Highest, Lowest
addition = Addition(A=hilonums.Highest, B=1)
subtraction = Subtraction(A=hilonums.Lowest, B=1)
subtraction_2 = Subtraction(A=addition, B=subtraction)
z_max = ClusterOutput(addition)
z_min = ClusterOutput(subtraction)
addition_2 = Addition(A=addition, B=subtraction)
division = Division(A=subtraction_2, B=2)
division_2 = Division(A=addition_2, B=2)
z_width_2 = ClusterOutput(division)
z_off_center_2 = ClusterOutput(division_2)

# ==== cluster XLabels
pln = ClusterInput()
pln_2 = Plane(pln)
deplane = DeconstructPlane(Plane=pln_2)  # -> Origin, XAxis, YAxis, ZAxis
devec = DeconstructVector(Vector=deplane.ZAxis)  # -> XComponent, YComponent, ZComponent
python = GhPythonScript(x=devec.XComponent, y=devec.YComponent, z=devec.ZComponent)  # -> out, a, b, c
# ---------- python: Python ----------
__author__ = "will"
__version__ = "2020.07.24"

import rhinoscriptsyntax as rs

if y > 0:
    a = 0
    b = 0
    c = 1
elif z < 0 and y <= 0:
    a = 0
    b = -1
    c = 0
    
else:
    a = x
    b = y
    c = z
# ---------- end python ----------
vec = VectorXYZ(XComponent=0, YComponent=python.b, ZComponent=python.c)  # -> Vector, Length
X = UnitX(Factor=1)
xprod = CrossProduct(VectorA=vec.Vector, VectorB=X, Unitize=False)  # -> Vector, Length
int = ClusterInput()
pl = ConstructPlane(Origin=deplane.Origin, XAxis=X, YAxis=xprod.Vector)
int_2 = Integer(int)
tag = TextTag3D(Location=pl, Text=int_2, Size=2.5, Colour=RGB(0, 0, 0), Justification=5)
lng = ListLength(List=pl)
division = Division(A=lng, B=2)
int_3 = Integer(division)
item = ListItem(List=pl, Index=int_3, Wrap=True)
deplane_2 = DeconstructPlane(Plane=item)  # -> Origin, XAxis, YAxis, ZAxis
B = ClusterInput()
multiplication = Multiplication(A=deplane_2.YAxis, B=B)
neg = Negative(Value=multiplication)
move = Move(Geometry=item, Motion=neg)  # -> Geometry, Transform
T = ClusterInput()
tag_2 = TextTag3D(Location=move.Geometry, Text=T, Size=2.5, Colour=RGB(0, 0, 0), Justification=5)

# ==== cluster YLabels
pln = ClusterInput()
pln_2 = Plane(pln)
deplane = DeconstructPlane(Plane=pln_2)  # -> Origin, XAxis, YAxis, ZAxis
devec = DeconstructVector(Vector=deplane.ZAxis)  # -> XComponent, YComponent, ZComponent
int = ClusterInput()
python = GhPythonScript(x=devec.XComponent, y=devec.YComponent, z=devec.ZComponent)  # -> out, a, b, c, flip
# ---------- python: Python ----------
__author__ = "will"
__version__ = "2020.07.24"

import rhinoscriptsyntax as rs

if x > 0 and z > 0:
    a = x
    b = y
    c = z
    flip = True
elif x > 0 and z <= 0:
    a = 1
    b = 0
    c = 0
    flip = True
elif z < 0 and x <= 0:
    a = -1
    b = 0
    c = 0
    flip = False
else:
    a = x
    b = y
    c = z
    flip = False
# ---------- end python ----------
int_2 = Integer(int)
Y = UnitY(Factor=1)
vec = VectorXYZ(XComponent=python.a, YComponent=0, ZComponent=python.c)  # -> Vector, Length
xprod = CrossProduct(VectorA=Y, VectorB=vec.Vector, Unitize=False)  # -> Vector, Length
neg = Negative(Value=Y)
neg_2 = Negative(Value=xprod.Vector)
item = ListItem(List=python.flip, Index=0, Wrap=True)
filter = StreamFilter(Gate=item, Stream0=xprod.Vector, Stream1=neg_2)
filter_2 = StreamFilter(Gate=item, Stream0=neg, Stream1=Y)
pl = ConstructPlane(Origin=deplane.Origin, XAxis=filter_2, YAxis=filter)
tag = TextTag3D(Location=pl, Text=int_2, Size=2.5, Colour=RGB(0, 0, 0), Justification=5)
lng = ListLength(List=pl)
division = Division(A=lng, B=2)
int_3 = Integer(division)
item_2 = ListItem(List=pl, Index=int_3, Wrap=True)
deplane_2 = DeconstructPlane(Plane=item_2)  # -> Origin, XAxis, YAxis, ZAxis
B = ClusterInput()
multiplication = Multiplication(A=deplane_2.YAxis, B=B)
neg_3 = Negative(Value=multiplication)
move = Move(Geometry=item_2, Motion=neg_3)  # -> Geometry, Transform
T = ClusterInput()
tag_2 = TextTag3D(Location=move.Geometry, Text=T, Size=2.5, Colour=RGB(0, 0, 0), Justification=5)

# ==== cluster ZLabels
z_axis_tick_labels = ClusterInput()
oriented_plane = ClusterInput()
roundd = RoundToDecimalPlace(ZAxisTickLabels=z_axis_tick_labels, DecimalPlace=2, RoundType=0)  # -> Rounded, Difference
oriented_plane_2 = Plane(oriented_plane)
deplane = DeconstructPlane(Plane=oriented_plane_2)  # -> Origin, XAxis, YAxis, ZAxis
devec = DeconstructVector(Vector=deplane.ZAxis)  # -> XComponent, YComponent, ZComponent
Z = UnitZ(Factor=1)
vec = VectorXYZ(XComponent=devec.XComponent, YComponent=devec.YComponent, ZComponent=0)  # -> Vector, Length
xprod = CrossProduct(VectorA=Z, VectorB=vec.Vector, Unitize=False)  # -> Vector, Length
pl = ConstructPlane(Origin=deplane.Origin, XAxis=xprod.Vector, YAxis=Z)
lng = ListLength(List=pl)
tag = TextTag3D(Location=pl, Text=roundd.Rounded, Size=2.5, Colour=RGB(0, 0, 0), Justification=5)
integer_division = IntegerDivision(A=lng, B=2)
item = ListItem(List=pl, Index=integer_division, Wrap=True)
deplane_2 = DeconstructPlane(Plane=item)  # -> Origin, XAxis, YAxis, ZAxis
B = ClusterInput()
multiplication = Multiplication(A=deplane_2.XAxis, B=B)
neg = Negative(Value=multiplication)
move = Move(Geometry=item, Motion=neg)  # -> Geometry, Transform
T = ClusterInput()
rotate = Rotate(Geometry=move.Geometry, Angle=1.570796327, Plane=move.Geometry)  # -> Geometry, Transform
tag_2 = TextTag3D(Location=rotate.Geometry, Text=T, Size=2.5, Colour=RGB(0, 0, 0), Justification=5)

# ==== cluster XYZOffsetAxes
num = ClusterInput()
num_2 = ClusterInput()
A = ClusterInput()
num_3 = Number(num)
num_4 = Number(num_2)
multiplication = Multiplication(A=A, B=-1.1)
num_5 = ClusterInput()
num_6 = Number(num_5)
num_7 = Number(multiplication)
subtraction = Subtraction(A=num_3, B=num_4)
N = ClusterInput()
division = Division(A=subtraction, B=7)
hilonums = HighestLowestNumbers(Numbers=flatten(N))  # -> Highest, Lowest
int = Integer(division)
python = GhPythonScript(Z_max=hilonums.Highest, Z_min=hilonums.Lowest, N=int)  # -> out, num, labels
# ---------- python: Python ----------
__author__ = "will"
__version__ = "2020.07.24"

import rhinoscriptsyntax as rs
from math import ceil, floor

if Z_max>0:
    if Z_min <= 0:
        R_pos = [0,Z_max]
        if Z_min <= 0:
            R_neg = [0,Z_min]
    elif Z_min > 0:
        R_pos = [Z_min, Z_max]
        R_neg = []
else:
    R_pos = []
    if Z_max < 0:
        R_neg = [Z_min,Z_max]
    else:
        R_neg = [0,Z_min]
        
R = (Z_max - Z_min)
print(R)

if R>N:
    I = (R - (R%N))/N
else:
    I = R/N
print(I)

Labels = set([])

if len(R_pos) > 0:
    if R>N:
        label = ceil(R_pos[0])
    else:
        label = R_pos[0]
    while label < Z_max:
        Labels.add(label)
        label += I
        

if len(R_neg) > 0:
    if R>N:
        label = floor(R_neg[0])
    else:
        label = R_neg[0]
    while label > Z_min:
        Labels.add(label)
        label -= I
        
labels = sorted(list(Labels))
num = len(labels)-1
print(len(labels))
# ---------- end python ----------
addition = Addition(A=num_7, B=5)
multiplication_2 = Multiplication(A=python.labels, B=num_6)
labels = ClusterOutput(python.labels)
item = ListItem(List=multiplication_2, Index=-1, Wrap=True)
item_2 = ListItem(List=multiplication_2, Index=0, Wrap=True)
neg = Negative(Value=num_7)
pt = ConstructPoint(XCoordinate=num_7, YCoordinate=num_7, ZCoordinate=item)
pt_2 = ConstructPoint(XCoordinate=num_7, YCoordinate=num_7, ZCoordinate=item_2)
pt_3 = ConstructPoint(XCoordinate=num_7, YCoordinate=num_7, ZCoordinate=num_4)
pt_4 = ConstructPoint(XCoordinate=num_7, YCoordinate=num_7, ZCoordinate=num_3)
ly = ClusterInput()
num_8 = ClusterInput()
pt_5 = ConstructPoint(XCoordinate=neg, YCoordinate=num_7, ZCoordinate=num_4)
pt_6 = ConstructPoint(XCoordinate=num_7, YCoordinate=neg, ZCoordinate=num_4)
pt_7 = ConstructPoint(XCoordinate=num_7, YCoordinate=addition, ZCoordinate=num_4)
ln = Line(StartPoint=pt_2, EndPoint=pt)
neg_2 = Negative(Value=addition)
pt_8 = ConstructPoint(XCoordinate=addition, YCoordinate=num_7, ZCoordinate=num_4)
num_9 = ClusterInput()
lx = ClusterInput()
ly_2 = Number(ly)
pt_9 = ClusterOutput(pt_3)
num_10 = Number(num_8)
ln_2 = Line(StartPoint=pt_3, EndPoint=pt_4)
ln_3 = Line(StartPoint=pt_5, EndPoint=pt_3)
Y = UnitY(Factor=1)
ln_4 = Line(StartPoint=pt_3, EndPoint=pt_6)
num_11 = Number(num_9)
lx_2 = Number(lx)
multiplication_3 = Multiplication(A=neg_2, B=2)
subtraction_2 = Subtraction(A=item, B=item_2)
X = UnitX(Factor=1)
dom = ConstructDomain(DomainStart=0, DomainEnd=ly_2)
line = LineSDL(Start=pt_7, Direction=Y, Length=ly_2)
dom_2 = ConstructDomain(DomainStart=0, DomainEnd=subtraction_2)
dom_3 = ConstructDomain(DomainStart=0, DomainEnd=lx_2)
line_2 = LineSDL(Start=pt_8, Direction=X, Length=lx_2)
range = Range(Domain=dom, Steps=num_10)
range_2 = Range(Domain=dom_2, Steps=python.num)
range_3 = Range(Domain=dom_3, Steps=num_11)
eval = EvaluateLength(Curve=line, Length=range, Normalized=False)  # -> Point, Tangent, Parameter
eval_2 = EvaluateLength(Curve=ln, Length=range_2, Normalized=False)  # -> Point, Tangent, Parameter
eval_3 = EvaluateLength(Curve=line_2, Length=range_3, Normalized=False)  # -> Point, Tangent, Parameter
Z = UnitZ(Factor=-1)
X_2 = UnitX(Factor=1)
crv = Curve([ln_3, ln_2, ln_4])
Z_2 = UnitZ(Factor=-1)
Y_2 = UnitY(Factor=1)
line_3 = LineSDL(Start=eval_2.Point, Direction=Vector(-5, -5, 0), Length=3)
line_4 = LineSDL(Start=eval.Point, Direction=Z, Length=1)
line_5 = LineSDL(Start=eval.Point, Direction=X_2, Length=3)
xy = XYPlane(Origin=Point(0, 0, 0))
line_6 = LineSDL(Start=eval_3.Point, Direction=Z_2, Length=1)
line_7 = LineSDL(Start=eval_3.Point, Direction=Y_2, Length=3)
xz = XZPlane(Origin=eval_2.Point)
R = ClusterInput()
pl_origin = PlaneOrigin(Base=xy, Origin=pt_2)
move = Move(Geometry=eval.Point, Motion=Vector(-3, 0, -3))  # -> Geometry, Transform
rotate = Rotate(Geometry=xz, Angle=0.7853981634, Plane=pl_origin)  # -> Geometry, Transform
pipe = Pipe(Curve=[crv, line_7, line_5, line_3, line_6, line_4], Radius=R, Caps=2)
move_2 = Move(Geometry=eval_3.Point, Motion=Vector(0, -3, -3))  # -> Geometry, Transform
xy_2 = XYPlane(Origin=move.Geometry)
P = ClusterOutput(pipe)
move_3 = Move(Geometry=rotate.Geometry, Motion=Vector(-5, -5, 0))  # -> Geometry, Transform
xy_3 = XYPlane(Origin=move_2.Geometry)
P_2 = ClusterOutput(xy_2)
xy_4 = XYPlane(Origin=move_3.Geometry)
P_3 = ClusterOutput(xy_3)
P_4 = ClusterOutput(xy_4)

# ==== cluster XYZTraceCuttingPlanes
num = ClusterInput()
x_y_pos = ClusterInput()
pdecon = Deconstruct(XYPos=x_y_pos)  # -> XComponent, YComponent, ZComponent
flip = FlipMatrix(Data=pdecon.YComponent)
num_2 = ClusterInput()
num_3 = ClusterInput()
item = ListItem(List=pdecon.XComponent, Index=0, Wrap=True)
num_4 = Number(num)
num_5 = Number(num_2)
item_2 = ListItem(List=flip, Index=0, Wrap=True)
num_6 = Number(num_3)
int = ClusterInput()
B = ClusterInput()
V = ClusterInput()
B_2 = ClusterInput()
A = ClusterInput()
B_3 = ClusterInput()
int_2 = ClusterInput()
num_7 = Number(item)
num_8 = Number(item_2)
multiplication = Multiplication(A=num_4, B=-1.1)
int_3 = Integer(int)
multiplication_2 = Multiplication(A=A, B=B_3)
B_4 = ClusterInput()
int_4 = Integer(int_2)
num_9 = Number(multiplication)
multiplication_3 = Multiplication(A=num_8, B=num_4)
ma = MassAddition(Input=int_3)  # -> Result, PartialResults
int_5 = ClusterInput()
addition = Addition(A=multiplication_2, B=B_4)
ma_2 = MassAddition(Input=int_4)  # -> Result, PartialResults
multiplication_4 = Multiplication(A=num_7, B=num_4)
multiplication_5 = Multiplication(A=num_9, B=-2)
devec = DeconstructVector(Vector=V)  # -> XComponent, YComponent, ZComponent
int_6 = Integer(int_5)
bool = Boolean(ma.Result)
bool_2 = Boolean(ma_2.Result)
ma_3 = MassAddition(Input=int_6)  # -> Result, PartialResults
pt = ConstructPoint(XCoordinate=num_9, YCoordinate=multiplication_3, ZCoordinate=num_5)
division = Division(A=devec.YComponent, B=B)
num_10 = Number(multiplication_5)
division_2 = Division(A=devec.XComponent, B=B_2)
pt_2 = ConstructPoint(XCoordinate=num_9, YCoordinate=num_9, ZCoordinate=addition)
pt_3 = ConstructPoint(XCoordinate=multiplication_4, YCoordinate=num_9, ZCoordinate=num_5)
int_7 = ClusterInput()
bool_3 = Boolean(ma_3.Result)
int_8 = Integer(int_7)
xy = XYPlane(Origin=pt_2)
xz = XZPlane(Origin=pt)
yz = YZPlane(Origin=pt_3)
pt_4 = ConstructPoint(XCoordinate=multiplication_4, YCoordinate=multiplication_3, ZCoordinate=0)
vec = VectorXYZ(XComponent=division_2, YComponent=division, ZComponent=0)  # -> Vector, Length
Z = UnitZ(Factor=1)
X = UnitX(Factor=1)
ma_4 = MassAddition(Input=int_8)  # -> Result, PartialResults
planesrf = PlaneSurface(Plane=xy, XSize=num_10, YSize=num_10)
python = GhPythonScript(V=vec.Vector, P=pt_4)  # -> out, t1, t2; inputs V: Point3d, P: Point3d
# ---------- python: Python ----------
__author__ = "will"

import rhinoscriptsyntax as rs

a,b,c = V[0],V[1],V[2]
p,q,r = P[0],P[1],P[2]

def sign(x):
    if x<0:
        return -1
    if x>0:
        return 1

if a==0:
    t1 = (sign(b)*55-q)/b
    t2 = (sign(b)*(-1)*55-q)/b

if b==0:
    t1 = (sign(a)*55-q)/a
    t2 = (sign(a)*(-1)*55-q)/a    

else:
    t1 = min([(sign(a)*55-p)/a,(sign(b)*55-q)/b])
    t2 = max([(sign(a)*(-1)*55-p)/a,(sign(b)*(-1)*55-q)/b])
# ---------- end python ----------
subtraction = Subtraction(A=num_6, B=num_5)
planesrf_2 = PlaneSurface(Plane=xz, XSize=num_10, YSize=subtraction)
planesrf_3 = PlaneSurface(Plane=yz, XSize=num_10, YSize=subtraction)
bool_4 = Boolean(ma_4.Result)
addition_2 = Addition(A=pt_4, B=vec.Vector)
addition_3 = Addition(A=pt_4, B=Z)
dispatch = Dispatch(List=planesrf, DispatchPattern=bool_3)  # -> ListA, ListB
dispatch_2 = Dispatch(List=planesrf_3, DispatchPattern=bool_2)  # -> ListA, ListB
multiplication_6 = Multiplication(A=vec.Vector, B=python.t2)
dispatch_3 = Dispatch(List=planesrf_2, DispatchPattern=bool)  # -> ListA, ListB
multiplication_7 = Multiplication(A=vec.Vector, B=python.t1)
dom = ConstructDomain(DomainStart=num_5, DomainEnd=num_6)
pl_3pt = Plane3Pt(PointA=pt_4, PointB=addition_2, PointC=addition_3)
subtraction_2 = Subtraction(A=multiplication_7, B=pt_4)
subtraction_3 = Subtraction(A=multiplication_6, B=pt_4)
num_11 = ClusterInput()
vlen = VectorLength(Vector=multiplication_6)
num_12 = ClusterInput()
B_5 = ClusterInput()
A_2 = ClusterOutput(dispatch_3.ListA)
vlen_2 = VectorLength(Vector=multiplication_7)
A_3 = ClusterOutput(dispatch_2.ListA)
A_4 = ClusterOutput(dispatch.ListA)
num_13 = Number(num_11)
num_14 = Number(num_12)
division_3 = Division(A=addition, B=B_5)
x_max = ClusterInput()
neg = Negative(Value=vlen)
dom_2 = ConstructDomain(DomainStart=neg, DomainEnd=vlen_2)
planesrf_4 = PlaneSurface(Plane=pl_3pt, XSize=dom_2, YSize=dom)
y_max = ClusterInput()
addition_4 = Addition(A=pt_4, B=multiplication_7)
addition_5 = Addition(A=pt_4, B=multiplication_6)
python_2 = GhPythonScript(x_width=num_14, x_max=x_max, x_pos=num_7)  # -> out, label
# ---------- python_2: Python ----------
__author__ = "will"
__version__ = "2020.07.22"

import rhinoscriptsyntax as rs

label = x_pos*(x_width)/(1.8)+(x_max-x_width/2)
# ---------- end python_2 ----------
dispatch_4 = Dispatch(List=planesrf_4, DispatchPattern=bool_4)  # -> ListA, ListB
python_3 = GhPythonScript(y_width=num_13, y_max=y_max, y_pos=num_8)  # -> out, label
# ---------- python_3: Python ----------
__author__ = "will"
__version__ = "2020.07.22"

import rhinoscriptsyntax as rs

label = y_pos*(y_width)/(1.8)+(y_max-y_width/2)
# ---------- end python_3 ----------
pt_5 = ConstructPoint(XCoordinate=multiplication_4, YCoordinate=num_9, ZCoordinate=num_6)
A_5 = ClusterOutput(dispatch_4.ListA)
pt_6 = ConstructPoint(XCoordinate=num_9, YCoordinate=multiplication_3, ZCoordinate=num_6)
panel = Panel(python.out)
move = Move(Geometry=pt_2, Motion=Vector(88, 111, 0))  # -> Geometry, Transform
roundd = RoundToDecimalPlace(NumberX=division_3, DecimalPlace=2, RoundType=0)  # -> Rounded, Difference
roundd_2 = RoundToDecimalPlace(NumberX=python_2.label, DecimalPlace=2, RoundType=0)  # -> Rounded, Difference
roundd_3 = RoundToDecimalPlace(NumberX=python_3.label, DecimalPlace=2, RoundType=0)  # -> Rounded, Difference
G = ClusterOutput(move.Geometry)
txt = Text("z = ")
txt_2 = Text("x = ")
txt_3 = Text("y = ")
join = TextJoin(Text=[txt, roundd.Rounded])
yz_2 = YZPlane(Origin=pt_5)
join_2 = TextJoin(Text=[txt_2, roundd_2.Rounded])
join_3 = TextJoin(Text=[txt_3, roundd_3.Rounded])
R = ClusterOutput(join)
xz_2 = XZPlane(Origin=pt_6)
R_2 = ClusterOutput(join_2)
R_3 = ClusterOutput(join_3)
P = ClusterOutput(yz_2)
P_2 = ClusterOutput(xz_2)

# ==== cluster TangentPlane
geo = ClusterInput()
geo_2 = Geometry(geo)
P = ClusterInput()
srf_cp = SurfaceClosestPoint(Point=P, Surface=geo_2)  # -> Point, UVPoint, Distance
evalsrf = EvaluateSurface(Surface=geo_2, Point=srf_cp.UVPoint)  # -> Point, Normal, UDirection, VDirection, Frame
P_2 = ClusterInput()
B = ClusterInput()
dispatch = Dispatch(List=evalsrf.Frame, DispatchPattern=P_2)  # -> ListA, ListB
neg = Negative(Value=B)
pln = Plane(dispatch.ListA)
dom = ConstructDomain(DomainStart=neg, DomainEnd=B)
planesrf = PlaneSurface(Plane=pln, XSize=dom, YSize=dom)
P_3 = ClusterOutput(planesrf)

# ==== cluster PointOnGraph
or_toggle_point = ClusterInput()
xy_coords = ClusterInput()
xy_size = ClusterInput()
toggle_point = ClusterInput()
int = Integer(or_toggle_point)
multiplication = Multiplication(XYCoords=xy_coords, XYSize=xy_size)
ma = MassAddition(Input=int)  # -> Result, PartialResults
dispatch = Dispatch(List=multiplication, DispatchPattern=ma.Result)  # -> ListA, ListB
x_scaling = ClusterInput()
y_scaling = ClusterInput()
scale_nu = ScaleNU(Geometry=dispatch.ListA, Plane=PlaneXY(0, 0, 0), XScaling=x_scaling, YScaling=y_scaling, ScaleZ=1)  # -> Geometry, Transform
toggle_pt = Boolean(toggle_point)
dispatch_2 = Dispatch(List=multiplication, DispatchPattern=ma.Result)  # -> ListA, ListB
trans = ClusterInput()
pdecon = Deconstruct(Point=dispatch_2.ListA)  # -> XComponent, YComponent, ZComponent
move = Move(Geometry=scale_nu.Geometry, Motion=trans)  # -> Geometry, Transform
pdecon_2 = Deconstruct(Point=move.Geometry)  # -> XComponent, YComponent, ZComponent
function = ClusterInput()
dispatch_3 = Dispatch(List=multiplication, DispatchPattern=ma.Result)  # -> ListA, ListB
z_scaling = ClusterInput()
python = GhPythonScript(x=pdecon_2.XComponent, y=pdecon_2.YComponent, function=function)  # -> out, z
# ---------- python: Python ----------
__author__ = "will"
__version__ = "2020.07.21"

import rhinoscriptsyntax as rs
from math import sin, cos, exp, log, sqrt, sinh, cosh, tan

#z = (x^2-sin(4*y)/3)

z = eval(function)
# ---------- end python ----------
multiplication_2 = Multiplication(A=python.z, ZScaling=z_scaling)
pt = ConstructPoint(XCoordinate=pdecon.XComponent, YCoordinate=pdecon.YComponent, ZCoordinate=multiplication_2)
pt_2 = Point([pt, dispatch_3.ListA])
ln = Line(StartPoint=pt, EndPoint=multiplication)
dispatch_4 = Dispatch(List=pt_2, DispatchPattern=toggle_pt)  # -> ListA, ListB
A = ClusterOutput(dispatch_3.ListA)
dispatch_5 = Dispatch(List=ln, DispatchPattern=toggle_pt)  # -> ListA, ListB
sph = Sphere(Base=dispatch_4.ListA, Radius=0.5)
pt_3 = ClusterOutput(pt)
S = ClusterOutput(sph)
A_2 = ClusterOutput(dispatch_5.ListA)
panel = Panel(python.out)

# ==== cluster F_YTangent
int = ClusterInput()
int_2 = Integer(int)
P = ClusterInput()
L = ClusterInput()
R = ClusterInput()
crv = ClusterInput()
P_2 = ClusterInput()
B = ClusterInput()
ma = MassAddition(Input=int_2)  # -> Result, PartialResults
crv_2 = Curve(crv)
bool = Boolean(ma.Result)
dispatch = Dispatch(List=crv_2, DispatchPattern=bool)  # -> ListA, ListB
crv_cp = CurveClosestPoint(Point=P_2, Curve=reparameterize(dispatch.ListA))  # -> Point, Parameter, Distance
cdiv = Derivatives(Curve=reparameterize(dispatch.ListA), Parameter=crv_cp.Parameter)  # -> Point, FirstDerivative
dispatch_2 = Dispatch(List=cdiv.FirstDerivative, DispatchPattern=P)  # -> ListA, ListB
unit = UnitVector(Vector=dispatch_2.ListA)
neg = Negative(Value=unit)
pdecon = Deconstruct(Point=cdiv.FirstDerivative)  # -> XComponent, YComponent, ZComponent
line = LineSDL(Start=cdiv.Point, Direction=neg, Length=L)
line_2 = LineSDL(Start=cdiv.Point, Direction=unit, Length=L)
vec = Vector(cdiv.FirstDerivative)
division = Division(A=pdecon.ZComponent, B=pdecon.YComponent)
join = JoinCurves(Curves=[line_2, line], Preserve=False)
unit_2 = UnitVector(Vector=vec)
pipe = Pipe(Curve=join, Radius=R, Caps=2)
division_2 = Division(A=unit_2, B=B)
P_3 = ClusterOutput(pipe)
f_y = ClusterOutput(division)
R_2 = ClusterOutput(division_2)

# ==== cluster F_XTangent
pt = ClusterInput()
crv = ClusterInput()
crv_2 = Curve(crv)
int = ClusterInput()
B = ClusterInput()
P = ClusterInput()
pt_2 = Point(pt)
L = ClusterInput()
int_2 = Integer(int)
R = ClusterInput()
ma = MassAddition(Input=int_2)  # -> Result, PartialResults
flip = FlipMatrix(Data=pt_2)
bool = Boolean(ma.Result)
dispatch = Dispatch(List=crv_2, DispatchPattern=bool)  # -> ListA, ListB
crv_cp = CurveClosestPoint(Point=flip, Curve=reparameterize(dispatch.ListA))  # -> Point, Parameter, Distance
cdiv = Derivatives(Curve=reparameterize(dispatch.ListA), Parameter=crv_cp.Parameter)  # -> Point, FirstDerivative
dispatch_2 = Dispatch(List=cdiv.FirstDerivative, DispatchPattern=P)  # -> ListA, ListB
vec = Vector(dispatch_2.ListA)
vec_2 = Vector(cdiv.FirstDerivative)
pdecon = Deconstruct(Point=cdiv.FirstDerivative)  # -> XComponent, YComponent, ZComponent
neg = Negative(Value=vec)
line = LineSDL(Start=cdiv.Point, Direction=vec, Length=L)
line_2 = LineSDL(Start=cdiv.Point, Direction=neg, Length=L)
unit = UnitVector(Vector=vec_2)
division = Division(A=pdecon.ZComponent, B=pdecon.XComponent)
join = JoinCurves(Curves=[line, line_2], Preserve=False)
division_2 = Division(A=unit, B=B)
pipe = Pipe(Curve=join, Radius=R, Caps=2)
flip_2 = FlipMatrix(Data=division)
D = ClusterOutput(flip_2)
f_x_unit_tangent = ClusterOutput(division_2)
f_x_tangent_line = ClusterOutput(pipe)

# ==== cluster LevelCurvesAndContours
num_contours = ClusterInput()
dom = ConstructDomain(DomainStart=-1, DomainEnd=1)
xy_size = ClusterInput()
nudge = ClusterInput()
range = Range(Domain=dom, NumContours=num_contours)
z_width_2 = ClusterInput()
z_off_center_2 = ClusterInput()
multiplication = Multiplication(A=range, Z_width2=z_width_2)
xy_size_2 = Number(xy_size)
addition = Addition(A=multiplication, Z_off_center2=z_off_center_2)
toggle_level_curves = ClusterInput()
toggle_contours = ClusterInput()
multiplication_2 = Multiplication(A=xy_size_2, B=-1.1)
toggle_level_curves_2 = Boolean(toggle_level_curves)
toggle_contours_2 = Boolean(toggle_contours)
addition_2 = Addition(A=addition, Nudge=nudge)
multiplication_3 = Multiplication(A=xy_size_2, B=2.2)
pt = ConstructPoint(XCoordinate=multiplication_2, YCoordinate=multiplication_2, ZCoordinate=addition_2)
xy = XYPlane(Origin=pt)
planesrf = PlaneSurface(Plane=xy, XSize=multiplication_3, YSize=multiplication_3)
or = GateOr(A=toggle_level_curves_2, B=toggle_contours_2)
dispatch = Dispatch(List=planesrf, ToggleLevelCurves=or)  # -> ListA, ListB
graph = ClusterInput()
bbx = BrepBrep(BrepA=dispatch.ListA, BrepB=graph)  # -> Curves, Points
toggle_level_planes = ClusterInput()
dispatch_2 = Dispatch(List=planesrf, ToggleLevelPlanes=toggle_level_planes)  # -> ListA, ListB
dispatch_3 = Dispatch(List=bbx.Curves, ToggleLevelCurves=toggle_level_curves_2)  # -> ListA, ListB
dispatch_4 = Dispatch(List=flatten(bbx.Curves), DispatchPattern=toggle_contours_2)  # -> ListA, ListB
B = ClusterInput()
A = ClusterOutput(dispatch_2.ListA)
A_2 = ClusterOutput(dispatch_3.ListA)
project = Project(Curve=dispatch_4.ListA, Brep=B, Direction=Vector(0, 0, 1))
C = ClusterOutput(project)

# ==== cluster Grids
ground_grid = ClusterInput()
L = ClusterInput()
toggle_surface_grid = ClusterInput()
toggle_ground_grid = ClusterInput()
ground_grid_2 = Geometry(ground_grid)
dispatch = Dispatch(List=L, ToggleSurfaceGrid=toggle_surface_grid)  # -> ListA, ListB
dispatch_2 = Dispatch(GroundGrid=ground_grid_2, ToggleGroundGrid=toggle_ground_grid)  # -> ListA, ListB
project = Project(Curve=ground_grid_2, Brep=dispatch.ListA, Direction=Vector(0, 0, 1))
A = ClusterOutput(dispatch_2.ListA)
pipe = Pipe(Curve=flatten(project), Radius=Slider(0.146, range=0..1), Caps=2)
P = ClusterOutput(pipe)

# ==== cluster ClipGraph
graph = ClusterInput()
clipping_curve = ClusterInput()
z_min = ClusterInput()
project = Project(ClippingCurve=clipping_curve, Graph=graph, Direction=Vector(0, 0, 1))
subtraction = Subtraction(Z_min=z_min, B=1)
srfsplit = SurfaceSplit(Surface=graph, Curves=project)
pt = ConstructPoint(XCoordinate=0, YCoordinate=0, ZCoordinate=subtraction)
project_2 = ProjectPoint(Point=pt, Direction=Vector(0, 0, 1), Geometry=srfsplit)  # -> Point, Index
toggle_graph = ClusterInput()
item = ListItem(List=srfsplit, Index=project_2.Index, Wrap=True)
dispatch = Dispatch(List=item, DispatchPattern=toggle_graph)  # -> ListA, ListB
i = ClusterOutput(item)
A = ClusterOutput(dispatch.ListA)

# ==== cluster GoundPlane
P = ClusterInput()
G = ClusterInput()
xy_size = ClusterInput()
pdecon = Deconstruct(Point=P)  # -> XComponent, YComponent, ZComponent
pt = ConstructPoint(XCoordinate=pdecon.XComponent, YCoordinate=pdecon.YComponent, ZCoordinate=0)
filter = StreamFilter(Gate=G, Stream0=pt, Stream1=P)
multiplication = Multiplication(XYSize=xy_size, B=2.2)
xy = XYPlane(Origin=filter)
toggle_ground_plane = ClusterInput()
planesrf = PlaneSurface(Plane=xy, XSize=multiplication, YSize=multiplication)
P_2 = ClusterOutput(planesrf)
dispatch = Dispatch(List=planesrf, ToggleGroundPlane=toggle_ground_plane)  # -> ListA, ListB
A = ClusterOutput(dispatch.ListA)

# ==== cluster XYZTraces
geo = ClusterInput()
geo_2 = Geometry(geo)
A = ClusterInput()
R = ClusterInput()
A_2 = ClusterInput()
A_3 = ClusterInput()
A_4 = ClusterInput()
I = ClusterInput()
bbx = BrepBrep(BrepA=A_3, BrepB=geo_2)  # -> ZTrace, Points
bbx_2 = BrepBrep(BrepA=A_2, BrepB=geo_2)  # -> YTrace, Points
bbx_3 = BrepBrep(BrepA=A_4, BrepB=geo_2)  # -> XTrace, Points
bbx_4 = BrepBrep(BrepA=A, BrepB=geo_2)  # -> DirTrace, Points
ma = MassAddition(Input=I)  # -> Result, PartialResults
lng = ListLength(List=bbx.ZTrace)
mod = Modulus(A=ma.Result, B=lng)
pipe = Pipe(Curve=bbx_2.YTrace, Radius=R, Caps=2)
pipe_2 = Pipe(Curve=bbx_3.XTrace, Radius=R, Caps=2)
pipe_3 = Pipe(Curve=bbx.ZTrace, Radius=R, Caps=2)
pipe_4 = Pipe(Curve=bbx_4.DirTrace, Radius=R, Caps=2)
item = ListItem(List=flatten(bbx.ZTrace), Index=mod, Wrap=True)
pipe_5 = Pipe(Curve=item, Radius=0.25, Caps=2)
y_trace_piped = ClusterOutput(pipe)
x_trace_piped = ClusterOutput(pipe_2)
z_trace_piped = ClusterOutput(pipe_3)
dir_trace_piped = ClusterOutput(pipe_4)
y_trace = ClusterOutput(bbx_2.YTrace)
x_trace = ClusterOutput(bbx_3.XTrace)
dir_trace = ClusterOutput(bbx_4.DirTrace)
P = ClusterOutput(pipe_5)

# ==== cluster GradientAndDirectional
P = ClusterInput()
x_scaling = ClusterInput()
num = ClusterInput()
num_2 = ClusterInput()
P_2 = ClusterInput()
num_3 = ClusterInput()
V = ClusterInput()
pt = ClusterInput()
A = ClusterInput()
A_2 = ClusterInput()
A_3 = ClusterInput()
G = ClusterInput()
A_4 = ClusterInput()
unit = UnitVector(Vector=V)
x_scaling_2 = Number(x_scaling)
num_4 = Number(num)
num_5 = Number(num_2)
num_6 = Number(num_3)
pt_2 = Point(pt)
pdecon = Deconstruct(Point=unit)  # -> XComponent, YComponent, ZComponent
devec = DeconstructVector(Vector=unit)  # -> XComponent, YComponent, ZComponent
division = Division(A=A_4, B=x_scaling_2)
division_2 = Division(A=A_2, B=num_6)
multiplication = Multiplication(A=A, B=pdecon.XComponent)
division_3 = Division(A=devec.XComponent, B=x_scaling_2)
division_4 = Division(A=devec.YComponent, B=num_6)
multiplication_2 = Multiplication(A=A_3, B=pdecon.YComponent)
addition = Addition(A=x_scaling_2, B=num_6)
vec = VectorXYZ(XComponent=division, YComponent=division_2, ZComponent=0)  # -> Vector, Length
addition_2 = Addition(A=multiplication, B=multiplication_2)
vec_2 = VectorXYZ(XComponent=division_3, YComponent=division_4, ZComponent=0)  # -> Vector, Length
multiplication_3 = Multiplication(A=vec_2.Vector, B=num_5)
multiplication_4 = Multiplication(A=vec.Vector, B=num_5)
multiplication_5 = Multiplication(A=addition_2, B=num_5)
division_5 = Division(A=2, B=addition)
amp = Amplitude(Vector=multiplication_4, Amplitude=division_5)
filter = StreamFilter(Gate=G, Stream0=multiplication_4, Stream1=amp)
dispatch = Dispatch(List=filter, DispatchPattern=P_2)  # -> ListA, ListB
dispatch_2 = Dispatch(List=multiplication_3, DispatchPattern=P)  # -> ListA, ListB
dispatch_3 = Dispatch(List=multiplication_5, DispatchPattern=P)  # -> ListA, ListB
basepoint = ClusterInput()
pretty_vec = PrettyVec(S=pt_2, D=dispatch_2.ListA, R=num_4)
pretty_vec_2 = PrettyVec(S=basepoint, D=dispatch_3.ListA, R=num_4)
pretty_vec_3 = PrettyVec(S=pt_2, D=dispatch.ListA, R=num_4)
geo = ClusterOutput(pretty_vec)
geo_2 = ClusterOutput(pretty_vec_2)
geo_3 = ClusterOutput(pretty_vec_3)

# ==== cluster Cluster
grid_res = ClusterInput()
T = ClusterInput()
grid_res_2 = Number(grid_res)
dom = ConstructDomain(DomainStart=0, DomainEnd=grid_res_2)
range = Range(Domain=dom, Steps=grid_res_2)
num = Number(range)
python = GhPythonScript(x=num)  # -> out, a
# ---------- python: Python ----------
__author__ = "will"

import rhinoscriptsyntax as rs

a=[0,0,x]
# ---------- end python ----------
path = ConstructPath(Indices=python.a)
item = TreeItem(Tree=T, Path=path, Index=range, Wrap=True)
item_2 = TreeItem(Tree=T, Path=path, Index=20, Wrap=True)
item_3 = TreeItem(Tree=T, Path=path, Index=0, Wrap=True)
flip = FlipMatrix(Data=item)
ln = Line(StartPoint=item_2, EndPoint=item_3)
intcrv = Interpolate(Vertices=flip, Degree=3, Periodic=False, KnotStyle=1)  # -> Curve, Length, Domain
crv = Curve([ln, intcrv.Curve])
crv_2 = ClusterOutput(crv)

# ==== cluster Cluster_2
T = ClusterInput()
grid_res = ClusterInput()
grid_res_2 = Number(grid_res)
subtraction = Subtraction(A=grid_res_2, B=1)
dom = ConstructDomain(DomainStart=0, DomainEnd=grid_res_2)
range = Range(Domain=dom, Steps=grid_res_2)
subtraction_2 = Subtraction(A=grid_res_2, B=range)
num = Number(range)
python = GhPythonScript(x=num)  # -> out, a; same code as python
python_2 = GhPythonScript(x=num)  # -> out, a; same code as python
path = ConstructPath(Indices=python_2.a)
path_2 = ConstructPath(Indices=python.a)
item = TreeItem(Tree=T, Path=path_2, Index=20, Wrap=True)
item_2 = TreeItem(Tree=T, Path="{0;0;20}", Index=subtraction_2, Wrap=True)
item_3 = TreeItem(Tree=T, Path="{0;0;0}", Index=subtraction_2, Wrap=True)
item_4 = TreeItem(Tree=T, Path=path_2, Index=0, Wrap=True)
ln = Line(StartPoint=item, EndPoint=item_4)  # -> flatten(Line)
ln_2 = Line(StartPoint=item_3, EndPoint=item_2)
crv = Curve(flatten([ln_2, ln]))
crv_2 = ClusterOutput(crv)

# ==== cluster Cluster_3
pt = ClusterInput()
grid_res = ClusterInput()
pt_2 = Point(pt)
grid_res_2 = Number(grid_res)
dom = ConstructDomain(DomainStart=0, DomainEnd=grid_res_2)
range = Range(Domain=dom, Steps=grid_res_2)
subtraction = Subtraction(A=grid_res_2, B=range)
num = Number(range)
python = GhPythonScript(x=num)  # -> out, a; same code as python
python_2 = GhPythonScript(x=num)  # -> out, a; same code as python
path = ConstructPath(Indices=python_2.a)
path_2 = ConstructPath(Indices=python.a)
item = TreeItem(Tree=pt_2, Path=path_2, Index=20, Wrap=True)
item_2 = TreeItem(Tree=pt_2, Path="{0;0;20}", Index=subtraction, Wrap=True)
item_3 = TreeItem(Tree=pt_2, Path="{0;0;0}", Index=subtraction, Wrap=True)
item_4 = TreeItem(Tree=pt_2, Path=path_2, Index=0, Wrap=True)
ln = Line(StartPoint=item, EndPoint=item_4)  # -> flatten(Line)
ln_2 = Line(StartPoint=item_3, EndPoint=item_2)
crv = Curve(flatten([ln_2, ln]))
crv_2 = ClusterOutput(crv)

# ==== cluster PrettyVec
D = ClusterInput()
S = ClusterInput()
R = ClusterInput()
vlen = VectorLength(Vector=D)
multiplication = Multiplication(A=R, B=3)
line = LineSDL(Start=S, Direction=D, Length=vlen)
multiplication_2 = Multiplication(A=multiplication, B=3)
subtraction = Subtraction(A=vlen, B=multiplication_2)
pipe = Pipe(Curve=line, Radius=R, Caps=2)
eval = EvaluateLength(Curve=line, Length=vlen, Normalized=False)  # -> Point, Tangent, Parameter
pl = PlaneNormal(Origin=eval.Point, ZAxis=D)
cone = Cone(Base=pl, Radius=multiplication, Length=multiplication_2)  # -> Cone, Tip
cap = CapHoles(Brep=cone.Cone)
geo = Geometry([cap, pipe])
geo_2 = ClusterOutput(geo)
