# Grasshopper definition velocity_and_accel.gh (Grasshopper 1.0.7)

number_slider = Slider(15.64, range=0..20)
velocity = BooleanToggle(True)
normal_tangential = BooleanToggle(True)
acceleration = BooleanToggle(True)
fit_circle = BooleanToggle(True)
number_slider_2 = Slider(0.001, range=0.001..1)
dt = Slider(0.001, range=0.001..1)
dom = ConstructDomain(DomainStart=0, DomainEnd=6.283185307)
addition = Addition(A=number_slider_2, B=number_slider)
range = Range(Domain=dom, Steps=Slider(84, range=0..100))
addition_2 = Addition(A=number_slider, B=dt)
addition_3 = Addition(A=addition, B=dt)
python = GhPythonScript(t=[number_slider, addition_2])  # -> out, x, y, z
# ---------- python: Python ----------
__author__ = "will"
__version__ = "2020.07.19"

import rhinoscriptsyntax as rs

from math import sin, cos,sqrt

x = (2+sin(3*t))*cos(2*t)
y = (2+sin(3*t))*sin(2*t)
z = cos(3*t)
# ---------- end python ----------
python_2 = GhPythonScript(t=[addition, addition_3])  # -> out, x, y, z; same code as python
subtraction = Subtraction(A=number_slider, B=dt)
python_3 = GhPythonScript(t=range)  # -> out, x, y, z; same code as python
addition_4 = Addition(A=number_slider, B=dt)
pt = ConstructPoint(XCoordinate=python.x, YCoordinate=python.y, ZCoordinate=python.z)
pt_2 = ConstructPoint(XCoordinate=python_2.x, YCoordinate=python_2.y, ZCoordinate=python_2.z)
pt_3 = ConstructPoint(XCoordinate=python_3.x, YCoordinate=python_3.y, ZCoordinate=python_3.z)
python_4 = GhPythonScript(t=subtraction)  # -> out, x, y, z; same code as python
python_5 = GhPythonScript(t=addition_4)  # -> out, x, y, z; same code as python
python_6 = GhPythonScript(t=number_slider)  # -> out, x, y, z; same code as python
number_slider_3 = Slider(0.03, range=0..1)
split = SplitList(List=pt, Index=1)  # -> ListA, ListB
split_2 = SplitList(List=pt_2, Index=1)  # -> ListA, ListB
intcrv = Interpolate(Vertices=pt_3, Degree=3, Periodic=True, KnotStyle=1)  # -> Curve, Length, Domain
pt_4 = ConstructPoint(XCoordinate=python_5.x, YCoordinate=python_5.y, ZCoordinate=python_5.z)
pt_5 = ConstructPoint(XCoordinate=python_6.x, YCoordinate=python_6.y, ZCoordinate=python_6.z)
pt_6 = ConstructPoint(XCoordinate=python_4.x, YCoordinate=python_4.y, ZCoordinate=python_4.z)
vec2pt = Vector2Pt(PointA=split_2.ListA, PointB=split_2.ListB, Unitize=False)  # -> Vector, Length
vec2pt_2 = Vector2Pt(PointA=split.ListA, PointB=split.ListB, Unitize=False)  # -> Vector, Length
number_slider_4 = Slider(0.03, range=0..1)
circle = Circle3Pt(PointA=pt_4, PointB=pt_5, PointC=pt_6)  # -> Circle, Plane, Radius
pipe = Pipe(Curve=intcrv.Curve, Radius=number_slider_3, Caps=0)
division = Division(A=vec2pt.Vector, B=dt)
division_2 = Division(A=vec2pt_2.Vector, B=dt)
dispatch = Dispatch(List=circle.Circle, DispatchPattern=fit_circle)  # -> ListA, ListB
number_slider_5 = Slider(4.028, range=0..10)
subtraction_2 = Subtraction(A=division, B=division_2)
pipe_2 = Pipe(Curve=dispatch.ListA, Radius=number_slider_3, Caps=0)
division_3 = Division(A=subtraction_2, B=number_slider_2)
number_slider_6 = Slider(0.031, range=0..1)
cluster = Cluster(G=pipe, A=Slider(255, range=0..255), N=Slider(10, range=0..19))
division_4 = Division(A=division_2, B=number_slider_5)
division_5 = Division(A=division_3, B=number_slider_5)
pl = PlaneNormal(Origin=split_2.ListA, ZAxis=vec2pt.Vector)
cluster_2 = Cluster(G=pipe_2, A=Slider(255, range=0..255), N=Slider(11, range=0..19))
dispatch_2 = Dispatch(List=division_4, DispatchPattern=velocity)  # -> ListA, ListB
dispatch_3 = Dispatch(List=division_5, DispatchPattern=acceleration)  # -> ListA, ListB
dprod = DotProduct(VectorA=division_5, VectorB=division_4, Unitize=False)
vlen = VectorLength(Vector=division_4)
sph = Sphere(Base=pl, Radius=Slider(0.063, range=0..1))
pretty_vec = PrettyVec(S=split.ListA, D=dispatch_2.ListA, R=number_slider_6)
number_slider_7 = Slider(255, range=0..255)
pretty_vec_2 = PrettyVec(S=split.ListA, D=dispatch_3.ListA, R=number_slider_6)
pow = Power(A=vlen, B=2)
division_6 = Division(A=dprod, B=pow)
multiplication = Multiplication(A=division_4, B=division_6)
cluster_3 = Cluster(G=sph, A=number_slider_7, N=Slider(0, range=0..19))
subtraction_3 = Subtraction(A=division_5, B=multiplication)
cluster_4 = Cluster(G=pretty_vec, A=number_slider_7, N=Slider(9, range=0..19))
cluster_5 = Cluster(G=pretty_vec_2, A=number_slider_7, N=Slider(12, range=0..19))
dispatch_4 = Dispatch(List=multiplication, DispatchPattern=normal_tangential)  # -> ListA, ListB
dispatch_5 = Dispatch(List=subtraction_3, DispatchPattern=normal_tangential)  # -> ListA, ListB
pretty_vec_3 = PrettyVec(S=split.ListA, D=dispatch_5.ListA, R=number_slider_6)
pretty_vec_4 = PrettyVec(S=split.ListA, D=dispatch_4.ListA, R=number_slider_6)
cluster_6 = Cluster(G=pretty_vec_3, A=number_slider_7, N=Slider(18, range=0..19))
cluster_7 = Cluster(G=pretty_vec_4, A=number_slider_7, N=Slider(18, range=0..19))

# ==== cluster PrettyVec
D = ClusterInput()
S = ClusterInput()
R = ClusterInput()
multiplication = Multiplication(A=R, B=3)
vlen = VectorLength(Vector=D)
multiplication_2 = Multiplication(A=multiplication, B=3)
subtraction = Subtraction(A=vlen, B=multiplication_2)
line = LineSDL(Start=S, Direction=D, Length=subtraction)
pipe = Pipe(Curve=line, Radius=R, Caps=2)
eval = EvaluateLength(Curve=line, Length=subtraction, Normalized=False)  # -> Point, Tangent, Parameter
pl = PlaneNormal(Origin=eval.Point, ZAxis=D)
cone = Cone(Base=pl, Radius=multiplication, Length=multiplication_2)  # -> Cone, Tip
cap = CapHoles(Brep=cone.Cone)
geo = Geometry([cap, pipe])
geo_2 = ClusterOutput(geo)

# ==== cluster Cluster
N = ClusterInput()
python = GhPythonScript(N=N)  # -> out, R, G, B
# ---------- python: Python ----------
__author__ = "will"
__version__ = "2020.07.20"

import rhinoscriptsyntax as rs

colors=[(0,0,0),(255,255,255),(115,115,115),(255,0,0),(0,255,0),(0,0,255),(255,255,0),(255,0,255),(0,255,255),(0,162,255),(252,124,21),(124,51,202),(23,151,59),(255,80,90),(255,80,226),(32,214,255),(0,92,0),(0,0,120),(112,255,49),(138,78,0)]

N=int(N)
R = colors[N][0]
G = colors[N][1]
B = colors[N][2]
# ---------- end python ----------
A = ClusterInput()
G = ClusterInput()
rgb = ColourRGB(Alpha=A, Red=python.R, Green=python.G, Blue=python.B)
preview = CustomPreview(Geometry=G, Material=rgb)
